# Grasshopper definition tests.gh (Grasshopper 1.0.8)
# Copyright: GNU Lesser General Public License Version 3
# plug-ins: RhinoCodePluginGH, Hops, semio

load = BooleanToggle(False)
hops = Hops(
    _Enabled=load,
    CacheResultsInMemory=True,
    CacheSolveResults=True,
    RemoteDefinitionLocation="C:\git\semio\examples\metabolism\kit.gh",
    RemoteSolveVersion=(0, 1, 0),
    ShowInput_Enabled=True,
    ShowInput_Path=False,
    SynchronousSolve=False)
txt = DecodeText(EncodedText=hops)
kit = DeserializeKit(Text=txt)
kt = Kit("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")
kit_2 = ModelKit(Kit=kt)  # -> Kit, Valid, Name, Description, Icon, Image, Preview, Version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
dsn = ModelDesign(Design=kit_2.Designs)  # -> Design, Valid, Name, Description, Icon, Image, Variant, View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
typ = ModelType(Type=kit_2.Types)  # -> Type, Valid, Name, Description, Icon, Image, Variant, Unit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
con = ModelConnection(Connection=dsn.Connections)  # -> Connection, Valid, ConnectedPieceId, ConnectedPieceTypePortId, ConnectingPieceId, ConnectingPieceTypePortId, Rotation, Tilt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
rep = ModelRepresentation(Representation=typ.Representations)  # -> Representation, Valid, Url, Mime, Tags
por = ModelPort(Port=typ.Ports)  # -> Port, Valid, Id, Description, Point, Direction, Locators, T
pce = ModelPiece(Piece=dsn.Pieces)  # -> Piece, Valid, Id, TypeName, TypeVariant, Plane, Center
qal = ModelQuality(Quality=typ.Qualities)  # -> Quality, Valid, Name, Value, Unit, Definition
aut = ModelAuthor(Author=typ.Authors)  # -> Author, Valid, Name, Email
qal_2 = ModelQuality(Quality=dsn.Qualities)  # -> Quality, Valid, Name, Value, Unit, Definition
aut_2 = ModelAuthor(Author=dsn.Authors)  # -> Author, Valid, Name, Email
mrg_a = MergeSeperatlyAppend(x=aut.Author, y=aut_2.Author)  # -> Mrgd; inputs x: tree, y: tree
# ---------- mrg_a: Python ----------
if ghenv.Component.RunCount<2:
    __author__ = "Ueli Saluz"
    __version__ = "2020.05.28"
    
    ghenv.Component.Name = "MergeSeperatly(Append)"
    ghenv.Component.NickName = "Mrg(A)"
    ghenv.Component.Description = "Merge inputs seperatly on a new path. Append index of input parameter for distincting."
    ghenv.Component.Message = "VER 1.0"

from System import Object
from Grasshopper import DataTree
from Grasshopper.Kernel import GH_ParamAccess as Access

if __name__ == "__main__":
    Mrgd = DataTree[Object]()
    access = Access()
    
    for input in ghenv.Component.Params.Input:  #set all Inputaccess to Tree Access
        input.Access = access.tree
    
    for i,input in enumerate(ghenv.Component.Params.Input):
        for j,source in enumerate(input.Sources):
            for path in source.VolatileData.Paths:
                Mrgd.AddRange(source.VolatileData[path],path.AppendElement(i))
# ---------- end mrg_a ----------
mrg_a_2 = MergeSeperatlyAppend(x=qal.Quality, y=qal_2.Quality)  # -> Mrgd; inputs x: tree, y: tree; same code as mrg_a
kt_2 = Kit(kit_2.Kit)
ty = Type(kit_2.Types)
pc = Piece(pce.Piece)
co = Connection(con.Connection)
dn = Design(kit_2.Designs)
rp = Representation(rep.Representation)
po = Port(por.Port)
ql = Quality(mrg_a_2)
au = Author(mrg_a)

dir = Directory()  # -> D
# ---------- dir: C# ----------
#region Usings
using System;
using System.Linq;
using System.Collections;
using System.Collections.Generic;
using System.Drawing;
using System.IO;

using Rhino;
using Rhino.Geometry;

using Grasshopper;
using Grasshopper.Kernel;
using Grasshopper.Kernel.Data;
using Grasshopper.Kernel.Types;
#endregion

public class Script_Instance : GH_ScriptInstance
{
    private void RunScript(ref object D)
    {
        D = Path.GetDirectoryName(this.GrasshopperDocument.FilePath);
    }
}
# ---------- end dir ----------
sep = Separator()  # -> S; same code as sep
par = ParentDirectory(D=dir)  # -> P; inputs D: String
# ---------- par: C# ----------
#region Usings
using System;
using System.Linq;
using System.Collections;
using System.Collections.Generic;
using System.Drawing;
using System.IO;

using Rhino;
using Rhino.Geometry;

using Grasshopper;
using Grasshopper.Kernel;
using Grasshopper.Kernel.Data;
using Grasshopper.Kernel.Types;
#endregion

public class Script_Instance : GH_ScriptInstance
{
    private void RunScript(string D, ref object P)
    {
        P = new DirectoryInfo(D).Parent;
    }
}
# ---------- end par ----------
concat = Concatenate(FragmentA=dir, FragmentD=sep, FragmentB="local")
par_2 = ParentDirectory(D=par)  # -> P; inputs D: String; same code as par
concat_2 = Concatenate(FragmentA=concat, FragmentC=sep, FragmentE="kit")
concat_3 = Concatenate(FragmentA=concat, FragmentD=sep, FragmentC="ai")
concat_4 = Concatenate(FragmentA=par_2, FragmentB=sep, FragmentC="examples")
concat_5 = Concatenate(FragmentA=concat_4, FragmentB=sep, FragmentC="metabolism")
concat_6 = Concatenate(FragmentA=par_2, FragmentC=sep, FragmentE="python", FragmentB=sep, FragmentD="engine", FragmentF=sep, FragmentG="log")
concat_7 = Concatenate(FragmentA=concat_5, FragmentB=sep, FragmentC="kit", FragmentD=".gh")

panel = Panel("-")
txt_2 = EncodeText(Text=concat_2)
panel_2 = Panel(txt_2)
concat_8 = Concatenate(FragmentA=par_2, FragmentB=sep, FragmentC="tests")
concat_9 = Concatenate(FragmentA=concat_8, FragmentB=sep, FragmentE="kit", FragmentF="_", FragmentC="metabolism", FragmentD=".json")

write = BooleanToggle(False)
write_2 = Write(T=txt, P=concat_9, R=write)  # -> S; inputs T: String, P: String, R: Boolean
# ---------- write_2: C# ----------
#region Usings
using System;
using System.Linq;
using System.Collections;
using System.Collections.Generic;
using System.Drawing;
using System.IO;

using Rhino;
using Rhino.Geometry;

using Grasshopper;
using Grasshopper.Kernel;
using Grasshopper.Kernel.Data;
using Grasshopper.Kernel.Types;
#endregion

public class Script_Instance : GH_ScriptInstance
{
    private void RunScript(string T, string P, bool R, ref object S)
    {
        if (R == true)
        {
            File.WriteAllText(P, T);
            S = true;
        }
        else
        {
            S = false;
        }
    }
}
# ---------- end write_2 ----------

ty_2 = Type(ty)
file_name = FileName(txt=ty_2)
typ_2 = SerializeType(Type=ty_2)
concat_10 = Concatenate(FragmentA=concat_8, FragmentC=sep, FragmentB=file_name, FragmentD=".json")
txt_3 = WriteText(T=typ_2, P=concat_10, R=write)  # -> S; inputs T: String, P: String, R: Boolean; same code as write_2

dn_2 = Design(dn)
fltdsn = FlattenDesign(Design=graft(dn_2), Types=ty_2)  # -> flatten(Design)
file_name_2 = FileName(txt=dn_2)
dsn_2 = SerializeDesign(Design=fltdsn)
dsn_3 = SerializeDesign(Design=dn_2)
concat_11 = Concatenate(FragmentA=concat_8, FragmentC=sep, FragmentB=file_name_2, FragmentF="_", FragmentE="flat", FragmentD=".json")
concat_12 = Concatenate(FragmentA=concat_8, FragmentC=sep, FragmentB=file_name_2, FragmentD=".json")
txt_4 = WriteText(T=dsn_3, P=concat_12, R=write)  # -> S; inputs T: String, P: String, R: Boolean; same code as write_2
txt_5 = WriteText(T=dsn_2, P=concat_11, R=write)  # -> S; inputs T: String, P: String, R: Boolean; same code as write_2

# ----
# Constructors
validate = BooleanToggle(False)

list = ValueList({"Dsn(Nakagin Capsule Tower)": 0, "Dsn(Nakagin Capsule Tower,Slanted)": 1, "Dsn(Nakagin Capsule Tower,Twisted)": 2, "Dsn(Nakagin Capsule Tower,Dancing,Explosion Axonometry)": 3}, selected="Dsn(Nakagin Capsule Tower)")
list_2 = ValueList({"Typ(Base)": 0, "Typ(Base,Blob)": 1, "Typ(Bridge)": 2, "Typ(Capital)": 3, "Typ(Cylindric Capital)": 4, "Typ(Capsule,\)": 5, "Typ(Capsule,/)": 6, "Typ(Capsule,q)": 7, "Typ(Capsule,p)": 8, "Typ(Capsule,J)": 9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}, selected=["Typ(Capsule,\)", "Typ(Capsule,q)", "Typ(Capsule,L)": 10, "Typ(Capsule,z)": 12, "Typ(Capsule with Balcony,/)": 14, "Typ(Capsule with Balcony,p)": 16, "Typ(Capsule with Balcony,J)": 17, "Typ(Capsule with Balcony,s)": 19, "Typ(Tambour)": 37, "Typ(Tambour,First Storey)": 38, "Typ(Tambour,Last Storey)": 39])

spt = ModelScreenPoint(Validate=validate)  # -> ScreenPoint, Valid, X, Y

# ----
# Url missing
rep_2 = ModelRepresentation(Validate=validate)  # -> Representation, Valid, Url, Mime, Tags

# ----
# Group missing
loc = ModelLocator(Validate=validate)  # -> Locator, Valid, Group, Subgroup

# ----
# Point missing
# Direction missing
por_2 = ModelPort(Validate=validate)  # -> Port, Valid, Id, Point, Direction, Locators, Locators_2, T

# ----
# Name missing
qal_3 = ModelQuality(Validate=validate)  # -> Quality, Valid, Name, Value, Unit, Definition

# ----
# Connected equal Connecting
con_2 = ModelConnection(Validate=validate)  # -> Connection, Valid, ConnectedPieceId, ConnectedPieceTypePortId, ConnectingPieceId, ConnectingPieceTypePortId, Rotation, Tilt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

# ----
# Normalization not affecting semantics
item = ListItem(List=dn, Index=0, Wrap=True)
dsn_4 = NormalizeDesign(dn=item)
shwdsn = ShowDesign(dn=item, ty=ty, mm="model/vnd.3dm")  # -> id_2, ur_2, pln_2
shwdsn_2 = ShowDesign(dn=dsn_4, ty=ty, mm="model/vnd.3dm")  # -> id_2, ur_2, pln_2
tsort = SortText(Keys=shwdsn_2.id_2, Values=shwdsn_2.pln_2, Culture=127)  # -> Keys, Values
tsort_2 = SortText(Keys=shwdsn.id_2, Values=shwdsn.pln_2, Culture=127)  # -> Keys, Values
expression = Expression(x=tsort_2.Values, y=tsort.Values, Expression="x=y")
mm = MassMultiplication(Input=expression)  # -> Result, PartialResults
bool = Boolean(mm.Result)
must_be_true = Panel(bool)

# ----
# Type Name missing
pce_2 = ModelPiece(Validate=validate)  # -> Piece, Valid, Id, TypeName, TypeVariant, Plane, DiagramPoint

panel_3 = Panel("A stack of 10 tambours with 8 capsules each. The main platform has a mirrored capsule on door 1 and 3. The split levels have a mirrored capsule on door 2.")

# ----
# Name missing
typ_3 = ModelType(Validate=validate)  # -> Type, Valid, Name, Description, Icon, Variant, Unit, Representations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

# ----
# Name missing
dsn_5 = ModelDesign(Validate=validate)  # -> Design, Valid, Name, Description, Icon, Variant, Unit, Pieces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

# ----
# Name missing
kit_3 = ModelKit(Validate=validate)  # -> Kit, Valid, Name, Description, Icon, Version, Remote, Homepage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

item_2 = ListItem(List=ty, Index=list_2, Wrap=True)
item_3 = ListItem(List=ty, Index=list_2, Wrap=True)
concat_13 = Concatenate(FragmentA=concat_6, FragmentC=sep, FragmentE="014")
panel_4 = Panel("IdToooooooooooooooooooooooooooooooooooooooLooooooooooooooooooooooooooooooooooooooooooooooooooongggggggggggggggggggggggggggggggggg")
panel_5 = Panel("NameToooooooooooooooooLoooooooooooooooooooooonggggggggggggggggggg")
panel_6 = Panel("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")
dsn_6 = PredictDesign(Description="Tambour with a capsule on every door.", Types=item_2, Run=Toggle(False))  # -> Success, Design
panel_7 = Panel("SecondName")
dsn_7 = PredictDesign(Description=panel_3, Types=item_3, Run=Toggle(False))  # -> Success, Design
concat_14 = Concatenate(FragmentA=concat_13, FragmentC=sep, FragmentE="predicted-design-healed.json")
file = ReadFile(File=concat_14, PerLineParse=False)
dn_3 = Design("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")
dn_4 = Design("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")
dn_5 = Design("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")
dsn_8 = DeserializeDesign(Text=file)
dn_6 = Design(dsn_8)

# ----
# Id too long
pt = ConstructPoint(XCoordinate=0, YCoordinate=0, ZCoordinate=0)
X = UnitX(Factor=1)
por_3 = ModelPort(Validate=validate, Id=panel_4, Point=pt, Direction=X)  # -> Port, Valid, Id, Point, Direction, Locators, Locators_2, T

# ----
# Url too long
rep_3 = ModelRepresentation(Validate=validate, Url="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")  # -> Representation, Valid, Url, Mime, Lod

# ----
# Lod too long
rep_4 = ModelRepresentation(Validate=validate, Url="https://url", Mime="https://url", Lod=panel_5)  # -> Representation, Valid, Url, Mime, Lod

# ----
# Description too long
typ_4 = ModelType(Validate=validate, Name="Name", Description=panel_6)  # -> Type, Valid, Name, Description, Icon, Variant, Unit, Representations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

rpltyp = ReplaceType(dn=dn_6, old_na="Capsule", new_na="Capsule with Balcony")
list_3 = ValueList({"1to500", "1to200"}, selected="1to500")

# ----
# Props
# Tag too long
rep_5 = ModelRepresentation(Validate=validate, Url="https://url", Mime="https://url")  # -> Representation, Valid, Url, Mime, Lod

# ----
# Id too long
pce_3 = ModelPiece(Validate=validate, Id=panel_4, TypeName="Name")  # -> Piece, Valid, Id, TypeName, TypeVariant, Plane, ScreenPoint

shwdsn_3 = ShowDesign_2(dn=dn_4, ty=ty, mm="model/vnd.3dm")  # -> id_2, ur_2, pa_ur_2, pln_2

# ----
# Description too long
dsn_9 = ModelDesign(Validate=validate, Name="Name", Description=panel_6)  # -> Design, Valid, Name, Description, Icon, Variant, Unit, Pieces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

concat_15 = Concatenate(FragmentA=concat_5, FragmentB=sep, FragmentC=shwdsn_3.pa_ur_2)

# ----
# Mime too long
rep_6 = ModelRepresentation(Validate=validate, Url="https://url", Mime=panel_4)  # -> Representation, Valid, Url, Mime, Lod

geo = LoadGeometry(path=flatten(concat_15), pln=flatten(shwdsn_3.pln_2), run=Toggle(True))  # -> object_4, col_2, shader_2
geo_2 = GeometryPreview(geo=flatten(geo.object_4))

# ----
# Description too long
kit_4 = ModelKit(Validate=validate, Name="Name", Description=panel_6)  # -> Kit, Valid, Name, Description, Icon, Version, Remote, Homepage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

number_slider = Slider(-0.5, range=-2..0)  # disabled
colmm = CollisionManyMany(Colliders=geo.object_4)  # -> Collision, Indices; disabled
panel_8 = Panel(geo.object_4)  # disabled
group = Group(Geometry=geo.object_4)  # -> flatten(Group); disabled
item_4 = ListItem(List=group, Index=0, Wrap=True)  # disabled
wrap = ShrinkWrap(Geometry=geo.object_4, Offset=number_slider, Smoothing=0, Optimization=10, FillHoles=True)  # -> flatten(Mesh); disabled

# ----
# Connected equal Connecting
con_3 = ModelConnection(Validate=validate, ConnectedPieceId="0", ConnectingPieceId="0")  # -> Connection, Valid, ConnectedPieceId, ConnectedPieceTypePortId, ConnectingPieceId, ConnectingPieceTypePortId, Rotation, Tilt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

item_5 = ListItem(List=geo.object_4, Index=0, Wrap=True)  # -> flatten(Item1), Item; disabled
panel_9 = Panel(colmm.Collision)  # disabled
panel_10 = Panel("-1")  # disabled
item_6 = ListItem(List=wrap, Index=0, Wrap=True)  # -> Item1, Item; disabled
replace = ReplaceItems(List=wrap, Indices=panel_10, Wrap=invert(False))  # disabled
c_script = CSharpScript(x=dn_4)  # -> out, a; disabled
# ---------- c_script: C# ----------
// Grasshopper Script Instance
#region Usings
using System;
using System.Linq;
using System.Collections;
using System.Collections.Generic;
using System.Drawing;

using Rhino;
using Rhino.Geometry;

using Grasshopper;
using Grasshopper.Kernel;
using Grasshopper.Kernel.Data;
using Grasshopper.Kernel.Types;
#endregion

public class Script_Instance : GH_ScriptInstance
{
    #region Notes
    /* 
      Members:
        RhinoDoc RhinoDocument
        GH_Document GrasshopperDocument
        IGH_Component Component
        int Iteration

      Methods (Virtual & overridable):
        Print(string text)
        Print(string format, params object[] args)
        Reflect(object obj)
        Reflect(object obj, string method_name)
    */
    #endregion

    private void RunScript(object x, object y, ref object a)
    {
        a = x.GetType();
    }
}
# ---------- end c_script ----------
clean = CleanTree(RemoveNulls=True, RemoveInvalid=True, RemoveEmpty=False, Tree=replace)  # disabled

# ----
# Piece not part
con_4 = ModelConnection(ConnectedPieceId="0", ConnectingPieceId="1")  # -> Connection, Valid, ConnectedPieceId, ConnectedPieceTypePortId, ConnectingPieceId, ConnectingPieceTypePortId, Rotation, Tilt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
dsn_10 = ModelDesign(Validate=validate, Name="Name", Connections=con_4.Connection)  # -> Design, Valid, Name, Description, Icon, Image, Variant, View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

colom = CollisionOneMany(Collider=item_6.Item1, Obstacles=clean)  # -> Collision, Index; disabled
mesh = Mesh(item_6.Item1)  # disabled
item_7 = ListItem(List=clean, Index=colom.Index, Wrap=True)  # disabled

mime = Mime({".glb": "model/gltf-binary", ".gltf": "model/gltf+json", ".stl": "model/stl", ".obj": "model/obj", ".blend": "model/x-blender", ".3dm": "model/vnd.3dm", ".ifc": "model/x-ifc", ".dwg": "model/acad", ".dxf": "model/dxf", ".rvt": "model/vnd.revit"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}, selected=".glb")
mime_2 = Mime({".glb": "model/gltf-binary", ".gltf": "model/gltf+json", ".stl": "model/stl", ".obj": "model/obj", ".blend": "model/x-blender", ".3dm": "model/vnd.3dm", ".ifc": "model/x-ifc", ".dwg": "model/acad", ".dxf": "model/dxf", ".rvt": "model/vnd.revit"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}, selected=".3dm")
mime_3 = Mime({".glb": "model/gltf-binary", ".gltf": "model/gltf+json", ".stl": "model/stl", ".obj": "model/obj", ".blend": "model/x-blender", ".3dm": "model/vnd.3dm", ".ifc": "model/x-ifc", ".dwg": "model/acad", ".dxf": "model/dxf", ".rvt": "model/vnd.revit"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}, selected=".ifc")
mime_4 = Mime({".glb": "model/gltf-binary", ".gltf": "model/gltf+json", ".stl": "model/stl", ".obj": "model/obj", ".blend": "model/x-blender", ".3dm": "model/vnd.3dm", ".ifc": "model/x-ifc", ".dwg": "model/acad", ".dxf": "model/dxf", ".rvt": "model/vnd.revit"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}, selected=".speckle": "model/vnd.speckle+json")
merge = Merge(Data1="1to200", Data2="does not exist")
rp_2 = Representation(rp)
mtchanc = MatchAncestor(AT="1to200", CT=rp_2)  # -> MAT; inputs AT: tree, CT: tree
# ---------- mtchanc: Python ----------
if ghenv.Component.RunCount<2:
    __author__ = "Ueli Saluz"
    __version__ = "2022.04.25"
    
    ghenv.Component.Name = "Match Ancestor"
    ghenv.Component.NickName = "MtchAnc"
    ghenv.Component.Description = "Duplicates all elements of an ancestor tree to match the amount of elements in the child tree."
    ghenv.Component.Message = "VER 1.1"
    
    ghenv.Component.Params.Input[0].Name = "AncestorTree"
    ghenv.Component.Params.Input[0].NickName = "AT"
    ghenv.Component.Params.Input[0].Description = "Ancestor tree that data will the duplicated until it matches the child tree"
    ghenv.Component.Params.Input[0].Optional = False
    
    ghenv.Component.Params.Input[1].Name = "ChildTree"
    ghenv.Component.Params.Input[1].NickName = "CT"
    ghenv.Component.Params.Input[1].Description = "Child tree that branches will the guide to duplicat the data of the ancestor tree"
    ghenv.Component.Params.Input[0].Optional = False
    
    ghenv.Component.Params.Output[0].Name = "MatchedAncestorTree"
    ghenv.Component.Params.Output[0].NickName = "MAT"
    ghenv.Component.Params.Output[0].Description = "Matched ancestor tree with the amount of items and the branch paths of the child tree"

from System import Object
from Grasshopper import DataTree

"""Returns a new tree with the ancestor data being duplicated along all child branches which where child paths of that ancestor.
    Inputs:
        ancestorTree: Ancestor tree that data will the duplicated until it matches the child tree
        childTree: Child tree that branches will the guide to duplicat the data of the ancestor tree
    Output:
        matchedAncestorTree: Matched ancestor tree with the amount of items and the branch paths of the child tree"""
def MatchAncestorTreeToChildTree (ancestorTree, childTree):
    
    matchedAncestorTree = DataTree[Object]()
    dummy = 0
    for i,pathAncestor in enumerate(ancestorTree.Paths):
        branch = ancestorTree.Branch(pathAncestor)
        if len(branch)!=1:
            raise Exception("Ancestor must be grafted and containing one item per branch")
        #The item to be duplicated
        item = branch[0]
        for j,pathChild in enumerate(childTree.Paths):
            #Returns a tuple and not like in the documentation described a bool with a pointer to the int to store the generations
            checkAncestor = pathChild.IsAncestor(pathAncestor,dummy)
            if(checkAncestor[0]):
                matchedAncestorTree.AddRange([item]*childTree.Branch(pathChild).Count,pathChild)
    return matchedAncestorTree

if __name__ == "__main__":
    MAT = MatchAncestorTreeToChildTree (AT,CT)
# ---------- end mtchanc ----------
mtchanc_2 = MatchAncestor(AT=mime_2, CT=rp_2)  # -> MAT; inputs AT: tree, CT: tree; same code as mtchanc
rep_7 = SelectRepresentation(rp=rp_2, mm=mime_4, tags=mtchanc)  # -> rp_5, ur_2, pa_ur_2
rep_8 = SelectRepresentation(rp=rp_2)  # -> rp_5, ur_2, pa_ur_2
rep_9 = SelectRepresentation(rp=rp_2, mm=mime)  # -> rp_5, ur_2, pa_ur_2
rep_10 = SelectRepresentation(rp=rp_2, mm=mime_2)  # -> rp_5, ur_2, pa_ur_2
rep_11 = SelectRepresentation(rp=rp_2, mm=mtchanc_2)  # -> rp_5, ur_2, pa_ur_2
rep_12 = SelectRepresentation(rp=rp_2, tags="1to200")  # -> rp_5, ur_2, pa_ur_2
rep_13 = SelectRepresentation(rp=rp_2, mm=mtchanc_2, tags=merge)  # -> rp_5, ur_2, pa_ur_2
rep_14 = SelectRepresentation(rp=rp_2, mm=mime_3, tags="does not exist")  # -> rp_5, ur_2, pa_ur_2
the_first_least_tagged_representation = Panel(rep_14.rp_5)
the_closest_tagged_representation = Panel(rep_13.rp_5)
the_first_default_representations = Panel(rep_8.rp_5)
the_glb_default_representations = Panel(rep_9.rp_5)
the_first_rhino_representation = Panel(rep_10.rp_5)
the_first_rhino_representation_2 = Panel(rep_11.rp_5)
the_first_1to200_representation = Panel(rep_12.rp_5)
the_speckle_1to200_representation = Panel(rep_7.rp_5)

panel_11 = Panel("1ef59aec9f6d93a2878d3771c6401209c9ba597c")
panel_12 = Panel("main-tag")
# UserObjects
panel_13 = Panel("usalu")
ghbkit = GitHubKit(domain="github.com", account="metabolism", repo="main", branch="main")  # -> remote_2, homepage_2
panel_14 = Panel(ghbkit.remote_2)
panel_15 = Panel(ghbkit.homepage_2)
panel_16 = Panel("https://github.com/usalu/metabolism/archive/1ef59aec9f6d93a2878d3771c6401209c9ba597c.zip")
panel_17 = Panel("https://github.com/usalu/metabolism/tree/1ef59aec9f6d93a2878d3771c6401209c9ba597c")

mime_5 = Mime({".glb": "model/gltf-binary", ".gltf": "model/gltf+json", ".stl": "model/stl", ".obj": "model/obj", ".blend": "model/x-blender", ".3dm": "model/vnd.3dm", ".ifc": "model/x-ifc", ".dwg": "model/acad", ".dxf": "model/dxf", ".rvt": "model/vnd.revit"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}, selected=".3dm")
mime_6 = Mime({".glb": "model/gltf-binary", ".gltf": "model/gltf+json", ".stl": "model/stl", ".obj": "model/obj", ".blend": "model/x-blender", ".3dm": "model/vnd.3dm", ".ifc": "model/x-ifc", ".dwg": "model/acad", ".dxf": "model/dxf", ".rvt": "model/vnd.revit"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}, selected=".glb")
ty_3 = Type(ty)
dn_7 = Design(dn)
shwdsn_4 = ShowDesign_2(dn=dn_7, ty=ty_3, mm=mime_6, tags="collider")  # -> id_2, ur_2, pa_ur_2, pln_2
shwdsn_5 = ShowDesign_2(dn=dn_7, ty=ty_3)  # -> id_2, ur_2, pa_ur_2, pln_2
shwdsn_6 = ShowDesign_2(dn=dn_7, ty=ty_3, mm=mime_5)  # -> id_2, ur_2, pa_ur_2, pln_2
first_rhino_representation = Panel(shwdsn_6.ur_2)
first_default_representation = Panel(shwdsn_5.ur_2)
glb_collider_representation = Panel(shwdsn_4.ur_2)

dn_8 = Design(dn)
ty_4 = Type(ty)
item_8 = ListItem(List=dn_8, Index=0, Wrap=True)
dn_9 = Design()
dsn_11 = BakeDesign(dn=item_8, ty=ty_4, mm="model/vnd.3dm", R=Toggle(False))  # -> id_2, ur_2, pa_ur_2, pln_2; disabled

dn_10 = Design(dn)
seldsn = SelectDesign(dn=dn_10, na="Nakagin Capsule Tower")
seldsn_2 = SelectDesign(dn=dn_10, na="Nakagin Capsule Tower")
seldsn_3 = SelectDesign(dn=dn_10, na="Nakagin Capsule Tower")
seldsn_4 = SelectDesign(dn=dn_10, na="Nakagin Capsule Tower", variant="Dancing")
seldsn_5 = SelectDesign(dn=dn_10, na="Nakagin Capsule Tower", view="Explosion Axonometry")
default_variant_and_view = Panel(seldsn)
all_variants_and_default_view = Panel(seldsn_3)
variant_and_default_view = Panel(seldsn_4)
all_variants_and_all_views = Panel(seldsn_2)
all_variants_and_view = Panel(seldsn_5)

merge_2 = Merge(Data1="1to200", Data2="plan", Data3="floor")
merge_3 = Merge(Data1="1to200", Data2="plan")
merge_4 = Merge(Data1="plan", Data2="floor", Data3="ground")
merge_5 = Merge(Data1="1to200", Data2="plan", Data3="floor", Data4="ground")
mrg_a_3 = MergeSeperatlyAppend(x=merge_3, y=merge_4, z=merge_5)  # -> Mrgd; inputs x: tree, y: tree, z: tree; same code as mrg_a
jac = JaccardIndex_2(set1=merge_2, set2=mrg_a_3)
panel_19 = Panel(jac)
panel_20 = Panel(merge_2)
panel_21 = Panel(mrg_a_3)

dn_11 = Design(dn)
item_9 = ListItem(List=dn_11, Index=0, Wrap=True)  # -> Item, Item1, Item2
inpdsn = InterpolateDesigns(S=item_9.Item1, T=item_9.Item2, t=Slider(0.4, range=0..1))  # -> dn_s_u_t_2, dn_s_t_2, dn_t_s_2
shwdsn_7 = ShowDesign_4(mm="model/vnd.3dm")  # -> id_2, ur_2, pa_ur_2, pln_2

test = BooleanToggle(False)

# ----
# Creating Kit without losing information
kit_5 = DeleteKit(Url=concat_2, Run=test)
kt_3 = Kit(kt_2)
expression_2 = Expression(x=test, y=kit_5, Expression="x")
kit_6 = SerializeKit(Kit=kt_3)
kit_7 = CreateKit(Kit=kt_3, Uri=concat_2, Run=expression_2)
expression_3 = Expression(x=test, y=kit_7, Expression="x")
kit_8 = LoadKit(Uri=concat_2, Run=expression_3)  # -> Success, Kit, LocalDirectory
kit_9 = SerializeKit(Kit=kit_8.Kit)
expression_4 = Expression(x=kit_6, y=kit_9, Expression="x=y")
must_be_true_2 = Panel(expression_4)

# ----
# Overwrite types and designs
expression_5 = Expression(x=test, y=must_be_true_2, Expression="x")
kt_4 = Kit(kt_2)
kit_10 = ModelKit(Kit=kt_4)  # -> Kit, Valid, Name, Description, Icon, Image, Preview, Version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
kit_11 = DeleteKit(Url=concat_2, Run=expression_5)
expression_6 = Expression(x=expression_5, y=kit_11, Expression="x")
kit_12 = NormalizeKit(kt=kt_4)
trim = TrimTree(Tree=kit_10.Types, Depth=1)
trim_2 = TrimTree(Tree=kit_10.Designs, Depth=1)
kit_13 = CreateKit(Kit=kt_4, Uri=concat_2, Run=test)
kit_14 = SerializeKit(Kit=kit_12)
typ_5 = PutType(Type=trim, Uri=concat_2, Run=False)
dsn_12 = PutDesign(Design=trim_2, Uri=concat_2, Run=False)
expression_7 = Expression(x=expression_5, y=kit_13, Expression="x")
item_10 = ListItem(List=typ_5, Index=0, Wrap=True)
expression_8 = Expression(x=expression_5, y=item_10, Expression="x")
item_11 = ListItem(List=dsn_12, Index=0, Wrap=True)
kit_15 = LoadKit(Uri=concat_2, Run=expression_7)  # -> Success, Kit, LocalDirectory
expression_9 = Expression(x=expression_5, y=kit_15.Success, Expression="x")
expression_10 = Expression(x=expression_5, y=item_11, Expression="x")
kit_16 = LoadKit(Uri=concat_2, Run=expression_10)  # -> Success, Kit, LocalDirectory
kit_17 = NormalizeKit(kt=kit_16.Kit)
kit_18 = SerializeKit(Kit=kit_17)
expression_11 = Expression(x=kit_14, y=kit_18, Expression="x=y")
must_be_true_3 = Panel(expression_11)

and = GateAnd(A=must_be_true_2, B=must_be_true_3, C=must_be_true_2)
must_be_true_4 = Panel(and)

# ==== cluster ShowDesign: Show a design by flattening it and selecting only representations with the same mime, lod and tags.
ty = ClusterInput()
dn = ClusterInput()
mm = ClusterInput()
lod = ClusterInput()
tags = ClusterInput()
ty_2 = Type(ty)
mm_2 = Mime(mm)
tags_2 = Tags(tags)
dn_2 = Design(dn)
lod_2 = Lod(lod)
fltdsn = FlattenDesign(Design=dn_2, Type=ty_2)
typ = ModelType(Type=ty_2)  # -> Type, Valid, Name, Description, Icon, Variant, Unit, Representations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
dsn = ModelDesign(Design=fltdsn)  # -> Design, Valid, Name, Description, Icon, Variant, Unit, Pieces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
tstat = TreeStatistics(Tree=typ.Representations)  # -> Paths, Length, Count
trim = TrimTree(Tree=dsn.Pieces, Depth=1)
pce = ModelPiece(Piece=trim)  # -> Piece, Valid, Id, TypeName, TypeVariant, Plane, ScreenPoint
lng = ListLength(List=ty_2)
expression = Expression(x=graft(pce.TypeName), y=typ.Name, Expression="x=y")
expression_2 = Expression(x=graft(pce.TypeVariant), y=typ.Variant, Expression="x=y")
series = Series(Start=0, Step=1, Count=lng)
and = GateAnd(A=expression, B=expression_2)
trim_2 = TrimTree(Tree=series, Depth=1)
cull = CullPattern(List=ty_2, CullPattern=and)
txt = Text(cull)
txt_2 = Text(ty_2)
expression_3 = Expression(x=txt, y=txt_2, Expression="x=y")
cull_2 = CullPattern(List=trim_2, CullPattern=expression_3)
trim_3 = TrimTree(Tree=cull_2, Depth=1)
item = ListItem(List=tstat.Paths, Index=trim_3, Wrap=True)
branch = TreeBranch(Tree=typ.Representations, Path=item, MaintainPaths=False)
mrg_p = MergeSeperatlyPrepend(x=branch)  # -> Mrgd; inputs x: tree
# ---------- mrg_p: Python ----------
if ghenv.Component.RunCount<2:
    __author__ = "Ueli Saluz"
    __version__ = "2020.05.28"
    
    ghenv.Component.Name = "MergeSeperatly(Prepend)"
    ghenv.Component.NickName = "Mrg(P)"
    ghenv.Component.Description = "Merge inputs seperatly on a new path. Prepend index of input parameter for distincting."
    ghenv.Component.Message = "VER 1.0"

from System import Object
from Grasshopper import DataTree
from Grasshopper.Kernel import GH_ParamAccess as Access

if __name__ == "__main__":
    Mrgd = DataTree[Object]()
    access = Access()
    
    for input in ghenv.Component.Params.Input:  #set all Inputaccess to Tree Access
        input.Access = access.tree
    
    for i,input in enumerate(ghenv.Component.Params.Input):
        for j,source in enumerate(input.Sources):
            for path in source.VolatileData.Paths:
                Mrgd.AddRange(source.VolatileData[path],path.PrependElement(i))
# ---------- end mrg_p ----------
rep = ModelRepresentation(Representation=mrg_p)  # -> Representation, Valid, Url, Mime, Lod
expression_4 = Expression(x=rep.Mime, y=mm_2, Expression="x=y")
cull_3 = CullPattern(List=rep.Representation, CullPattern=expression_4)
rep_2 = ModelRepresentation(Representation=cull_3)  # -> Representation, Valid, Url, Mime, Lod
expression_5 = Expression(x=rep_2.Lod, y=lod_2, Expression="x=y")
cull_4 = CullPattern(List=rep_2.Representation, CullPattern=expression_5)
trim_4 = TrimTree(Tree=cull_4, Depth=1)
rep_3 = ModelRepresentation(Representation=trim_4)  # -> Representation, Valid, Url, Mime, Lod
ur = Url(rep_3.Url)
id = Id(pce.Id)
pln = Plane(pce.Plane)
ur_2 = ClusterOutput(ur)
pln_2 = ClusterOutput(pln)
id_2 = ClusterOutput(id)

# ==== cluster NormalizeDesign: Normalize a design for this document. This includes changing the unit to the document unit and rescaling the affected values. Further it reoders pieces, connections and qualities. Connections might be swapped, so that the connected piece id is lexically first.
dn = ClusterInput()
dn_2 = Design(graft(dn))
dsn = ModelDesign()  # -> Design, Valid, Name, Description, Icon, Variant, Unit, Pieces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
dsn_2 = ModelDesign(Design=dn_2)  # -> Design, Valid, Name, Description, Icon, Variant, Unit, Pieces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
trim = TrimTree(Tree=dsn_2.Pieces, Depth=1)
trim_2 = TrimTree(Tree=dsn_2.Qualities, Depth=1)
trim_3 = TrimTree(Tree=dsn_2.Connections, Depth=1)
cnvunt = ConvertUnit(Value=1, FromUnit=dsn_2.Unit, ToUnit=dsn.Unit)
con = ModelConnection(Connection=trim_3)  # -> Connection, Valid, ConnectedPieceId, ConnectedPieceTypePortId, ConnectingPieceId, ConnectingPieceTypePortId, Rotation, Tilt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
multiplication = Multiplication(A=con.Gap, B=cnvunt)
multiplication_2 = Multiplication(A=con.Shift, B=cnvunt)
con_2 = ModelConnection(Connection=con.Connection, Gap=multiplication, Shift=multiplication_2)  # -> Connection, Valid, ConnectedPieceId, ConnectedPieceTypePortId, ConnectingPieceId, ConnectingPieceTypePortId, Rotation, Tilt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
merge = Merge(Data1=graft(con_2.ConnectedPieceId), Data2=graft(con_2.ConnectingPieceId))
tsort = SortText(Keys=merge, Culture=127)  # -> Keys, Values
trim_4 = TrimTree(Tree=tsort.Keys, Depth=1)
expression = Expression(x=merge, y=trim_4, Expression="x=y")
item = ListItem(List=expression, Index=0, Wrap=True)
trim_5 = TrimTree(Tree=item, Depth=1)
dispatch = Dispatch(List=con_2.Connection, DispatchPattern=trim_5)  # -> ListA, ListB
con_3 = ModelConnection(Connection=dispatch.ListB)  # -> Connection, Valid, ConnectedPieceId, ConnectedPieceTypePortId, ConnectingPieceId, ConnectingPieceTypePortId, Rotation, Tilt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
con_4 = ModelConnection(
    Connection=dispatch.ListB,
    ConnectedPieceId=con_3.ConnectingPieceId,
    ConnectedPieceTypePortId=con_3.ConnectingPieceTypePortId,
    ConnectingPieceId=con_3.ConnectedPieceId,
    ConnectingPieceTypePortId=con_3.ConnectedPieceTypePortId)  # -> Connection, Valid, ConnectedPieceId, ConnectedPieceTypePortId, ConnectingPieceId, ConnectingPieceTypePortId, Rotation, Tilt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
merge_2 = Merge(Data1=dispatch.ListA, Data2=con_4.Connection)
con_5 = ModelConnection(Connection=merge_2)  # -> Connection, Valid, ConnectedPieceId, ConnectedPieceTypePortId, ConnectingPieceId, ConnectingPieceTypePortId, Rotation, Tilt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
concat = Concatenate(FragmentA=con_5.ConnectedPieceId, FragmentC="##", FragmentB=con_5.ConnectingPieceId)
qal = ModelQuality(Quality=trim_2)  # -> Quality, Valid, Name, Value, Unit, Definition
pce = ModelPiece(Piece=trim)  # -> Piece, Valid, Id, TypeName, TypeVariant, Plane, ScreenPoint
tsort_2 = SortText(Keys=concat, Values=con_5.Connection, Culture=127)  # -> Keys, Values
tsort_3 = SortText(Keys=qal.Name, Values=qal.Quality, Culture=127)  # -> Keys, Values
tsort_4 = SortText(Keys=pce.Id, Values=pce.Piece, Culture=127)  # -> Keys, Values
trim_6 = TrimTree(Tree=tsort_2.Values, Depth=1)
trim_7 = TrimTree(Tree=tsort_3.Values, Depth=1)
trim_8 = TrimTree(Tree=tsort_4.Values, Depth=1)
dsn_3 = ModelDesign(Design=dsn_2.Design, Unit=dsn.Unit, Pieces=trim_8, Connections=trim_6, Qualities=trim_7)  # -> Design, Valid, Name, Description, Icon, Variant, Unit, Pieces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
trim_9 = TrimTree(Tree=dsn_3.Design, Depth=1)
dn_3 = Design(trim_9)
dn_4 = ClusterOutput(dn_3)

# ==== cluster GitHubKit: Get the uri and the homepage of the remote kit of a specific version (either a branch name, a tag name or a commit sha) for a kit hosted as a repository on GitHub.
domain = ClusterInput()
account = ClusterInput()
repo = ClusterInput()
branch = ClusterInput()
tag = ClusterInput()
commit = ClusterInput()
commit_2 = Text(commit)
domain_2 = Text(domain)
account_2 = Text(account)
repo_2 = Text(repo)
branch_2 = Text(branch)
tag_2 = Text(tag)
null = NullItem(Item=domain_2)  # -> NullFlags, InvalidFlags, Description

null_2 = NullItem(Item=tag_2)  # -> NullFlags, InvalidFlags, Description
null_3 = NullItem(Item=commit_2)  # -> NullFlags, InvalidFlags, Description
null_4 = NullItem(Item=branch_2)  # -> NullFlags, InvalidFlags, Description
not = GateNot(A=null_2.NullFlags)
not_2 = GateNot(A=null_3.NullFlags)
not_3 = GateNot(A=null_4.NullFlags)
merge = Merge(Data1=not_3, Data2=not, Data3=not_2)
int = Integer(merge)
ma = MassAddition(Input=int)  # -> Result, PartialResults
expression = Expression(x=ma.Result, Expression="x≠1")
null_5 = NullItem(Item=account_2)  # -> NullFlags, InvalidFlags, Description
null_6 = NullItem(Item=repo_2)  # -> NullFlags, InvalidFlags, Description
or = GateOr(A=expression, D=null.NullFlags, B=null_5.NullFlags, C=null_6.NullFlags)

filter = StreamFilter(Gate=null_4.NullFlags, Stream0="heads", Stream1="tags")
filter_2 = StreamFilter(Gate=null_4.NullFlags, Stream0=branch_2, Stream1=tag_2)
concat = Concatenate(FragmentA="https://", FragmentE=domain_2, FragmentF="/", FragmentB=account_2, FragmentC="/", FragmentD=repo_2)
concat_2 = Concatenate(FragmentA="refs/", FragmentB=filter, FragmentC="/")
filter_3 = StreamFilter(Gate=null_3.NullFlags, Stream1=concat_2)
filter_4 = StreamFilter(Gate=null_3.NullFlags, Stream0=commit_2, Stream1=filter_2)
concat_3 = Concatenate(FragmentA=concat, FragmentE="/archive/", FragmentC=filter_3, FragmentF=filter_4, FragmentG=".zip")
concat_4 = Concatenate(
    FragmentA=concat,
    FragmentB="/",
    FragmentC="tree",
    FragmentF="/",
    FragmentD=branch_2,
    FragmentE=tag_2,
    FragmentG=commit_2)

filter_5 = StreamFilter(Gate=or, Stream0=concat_3)
filter_6 = StreamFilter(Gate=or, Stream0=concat_4)
remote = Remote(filter_5)
homepage = Homepage(filter_6)
remote_2 = ClusterOutput(remote)
homepage_2 = ClusterOutput(homepage)

# ==== cluster ShowDesign_2: Show a design by flattening it and selecting representations based on mime and tags. See Select Representations for details of the representation query.
ty = ClusterInput()
dn = ClusterInput()
mm = ClusterInput()
tags = ClusterInput()
dn_2 = Design(graft(dn))
ty_2 = Type(ty)
mm_2 = Mime(mm)
tags_2 = Tags(tags)
fltdsn = FlattenDesign(Design=dn_2, Type=ty_2)
dsn = ModelDesign(Design=fltdsn)  # -> Design, Valid, Name, Description, Icon, Image, Variant, View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
typ = ModelType(Type=ty_2)  # -> Type, Valid, Name, Description, Icon, Image, Variant, Unit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
trim = TrimTree(Tree=dsn.Pieces, Depth=1)
tstat = TreeStatistics(Tree=typ.Representations)  # -> Paths, Length, Count
pce = ModelPiece(Piece=trim)  # -> Piece, Valid, Id, TypeName, TypeVariant, Plane, ScreenPoint
expression = Expression(x=graft(pce.TypeName), y=typ.Name, Expression="x=y")
expression_2 = Expression(x=graft(pce.TypeVariant), y=typ.Variant, Expression="x=y")
and = GateAnd(A=expression, B=expression_2)
cull = CullPattern(List=ty_2, CullPattern=and)
lng = ListLength(List=ty_2)
txt = Text(cull)
series = Series(Start=0, Step=1, Count=lng)
txt_2 = Text(ty_2)
expression_3 = Expression(x=txt, y=txt_2, Expression="x=y")
trim_2 = TrimTree(Tree=series, Depth=1)
cull_2 = CullPattern(List=trim_2, CullPattern=expression_3)
trim_3 = TrimTree(Tree=cull_2, Depth=1)
item = ListItem(List=tstat.Paths, Index=trim_3, Wrap=True)
branch = TreeBranch(Tree=typ.Representations, Path=item, MaintainPaths=False)
mrg_p = MergeSeperatlyPrepend(x=branch)  # -> Mrgd; inputs x: tree; same code as mrg_p
rep = SelectRepresentation(rp=mrg_p, mm=mm_2, tags=tags_2)  # -> rp_5, ur_2, pa_ur_2
trim_4 = TrimTree(Tree=rep.ur_2, Depth=1)
trim_5 = TrimTree(Tree=rep.pa_ur_2, Depth=1)
unflatten = UnflattenTree(Tree=trim_4, Guide=trim)
unflatten_2 = UnflattenTree(Tree=trim_5, Guide=trim)
id = Id(pce.Id)
ur = Url(unflatten)
pa_ur = Url(unflatten_2)
pln = Plane(pce.Plane)
id_2 = ClusterOutput(id)
ur_2 = ClusterOutput(ur)
pa_ur_2 = ClusterOutput(pa_ur)
pln_2 = ClusterOutput(pln)

# ==== cluster LoadGeometry: Load local geometry from absolute file paths to planes.
path = ClusterInput()
pln = ClusterInput()
run = ClusterInput()
pln_2 = Plane(graft(pln))
path_2 = FilePath(path)
run_2 = Boolean(run)
import = ImportContent(
    FilePath=path_2,
    Name="*",
    Layer="*",
    Linetype="*",
    HatchPattern="*",
    AnnotationStyles="*",
    Materials="*",
    BlockDefinitions="*",
    Import=run_2)  # -> ModelTransform, Objects, Layers, Linetypes, HatchPatterns, AnnotationStyles, Materials, BlockDefinitions
object = ModelObject(Object=import.Objects)  # -> Object, Geometry, Name, Layer, Visibility, Display, Drafting, Render
orient = Orient(Geometry=object.Geometry, Source=PlaneXY(0, 0, 0), Target=pln_2)  # -> Geometry, Transform
object_2 = ModelObject(Object=object.Object, Geometry=orient.Geometry)  # -> Object, Geometry, Name, Layer, Visibility, Display, Drafting, Render
layer = ModelLayer(Layer=object_2.Layer)  # -> Layer, Name, Hidden, Locked, DisplayColour, Material, Linetype
display = DisplayAttributes(Display=object_2.Display)  # -> Display, DisplayColour, DisplayMode
display_colour = DisplayColour(DisplayColour=layer.DisplayColour)  # -> DisplayColour, Source, Colour
material = ModelMaterial(Material=layer.Material)  # -> Material, Name, Shader
display_colour_2 = DisplayColour(DisplayColour=display.DisplayColour)  # -> DisplayColour, Source, Colour
object_3 = ModelObject(object_2.Object)
col = Colour(display_colour.DisplayColour)
shader = Shader(material.Shader)
preview = CustomPreview(Geometry=object_3, Material=material.Shader)
object_4 = ClusterOutput(object_3)
shader_2 = ClusterOutput(shader)
col_2 = ClusterOutput(col)

# ==== cluster NormalizeKit: Normalize a kit to this document. This normalizes all types and designs and reorders them. Types are reordered after name and variant and designs after name, variant and view.
kt = ClusterInput()
kt_2 = Kit(graft(kt))
kit = ModelKit(Kit=kt_2)  # -> Kit, Valid, Name, Description, Icon, Image, Preview, Version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
trim = TrimTree(Tree=kit.Designs, Depth=1)
trim_2 = TrimTree(Tree=kit.Types, Depth=1)
dsn = NormalizeDesign_2(dn=trim)
typ = NormalizeType(ty=trim_2)
typ_2 = ModelType(Type=typ)  # -> Type, Valid, Name, Description, Icon, Image, Variant, Unit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
dsn_2 = ModelDesign(Design=dsn)  # -> Design, Valid, Name, Description, Icon, Image, Variant, View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
concat = Concatenate(FragmentA=dsn_2.Name, FragmentB="##", FragmentC=dsn_2.Variant, FragmentD="##", FragmentE=dsn_2.View)
concat_2 = Concatenate(FragmentA=typ_2.Name, FragmentB="##", FragmentC=typ_2.Variant)
tsort = SortText(Keys=concat, Values=dsn_2.Design, Culture=127)  # -> Keys, Values
tsort_2 = SortText(Keys=concat_2, Values=typ_2.Type, Culture=127)  # -> Keys, Values
trim_3 = TrimTree(Tree=tsort.Values, Depth=1)
trim_4 = TrimTree(Tree=tsort_2.Values, Depth=1)
kit_2 = ModelKit(Kit=kit.Kit, Types=trim_4, Designs=trim_3)  # -> Kit, Valid, Name, Description, Icon, Image, Preview, Version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
trim_5 = TrimTree(Tree=kit_2.Kit, Depth=1)
kt_3 = Kit(trim_5)
kt_4 = ClusterOutput(kt_3)

# ==== cluster SelectDesign: Select a design with a name, an optional variant and an optional view. If no variant is provided it will select all variants. If you want to select the default variant then use the empty text. If no view is provided it will select all views. If you want to select the default view then use the empty text.
dn = ClusterInput()
na = ClusterInput()
variant = ClusterInput()
view = ClusterInput()
dn_2 = Design(dn)
na_2 = Name(na)
variant_2 = Variant(variant)
view_2 = View(view)
dsn = ModelDesign(Design=dn_2)  # -> Design, Valid, Name, Description, Icon, Image, Variant, View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
expression = Expression(x=dsn.Name, y=na_2, Expression="x=y")
cull = CullPattern(List=dsn.Design, CullPattern=expression)
dsn_2 = ModelDesign(Design=cull)  # -> Design, Valid, Name, Description, Icon, Image, Variant, View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
expression_2 = Expression(x=dsn_2.Variant, y=variant_2, Expression="x=y")
null = NullItem(Item=view_2)  # -> NullFlags, InvalidFlags, Description
cull_2 = CullPattern(List=dsn_2.Design, CullPattern=expression_2)
not = GateNot(A=null.NullFlags)
null_2 = NullItem(Item=variant_2)  # -> NullFlags, InvalidFlags, Description
and = GateAnd(A=not, B=null_2.NullFlags)
filter = StreamFilter(Gate=and, Stream0=cull_2, Stream1=cull)
dsn_3 = ModelDesign(Design=filter)  # -> Design, Valid, Name, Description, Icon, Image, Variant, View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
expression_3 = Expression(x=view_2, y=dsn_3.View, Expression="x=y")
cull_3 = CullPattern(List=dsn_3.Design, CullPattern=expression_3)
filter_2 = StreamFilter(Gate=null.NullFlags, Stream0=cull_3, Stream1=cull_2)
filter_3 = StreamFilter(Gate=null_2.NullFlags, Stream0=filter_2, Stream1=cull)
filter_4 = StreamFilter(Gate=and, Stream0=filter_3, Stream1=cull_3)
dn_3 = Design(filter_4)
dn_4 = ClusterOutput(dn_3)

# ==== cluster FileName
txt = ClusterInput()
txt_2 = Text(txt)
rep = ReplaceText(Text=txt_2, Find="Dsn", Replace="design", RecursiveReplace=False)
rep_2 = ReplaceText(Text=rep, Find="Typ", Replace="type", RecursiveReplace=False)
case = TextCase(Text=rep_2, Culture=127)  # -> UpperCase, LowerCase
rep_3 = ReplaceText(Text=case.LowerCase, Find="(", Replace="_", RecursiveReplace=False)
rep_4 = ReplaceText(Text=rep_3, Find=" ", Replace="-", RecursiveReplace=False)
rep_5 = ReplaceText(Text=rep_4, Find=")", RecursiveReplace=False)
rep_6 = ReplaceText(Text=rep_5, Find=",", Replace="_", RecursiveReplace=False)
rep_7 = ReplaceText(Text=rep_6, Find="\", Replace="backslash", RecursiveReplace=False)
rep_8 = ReplaceText(Text=rep_7, Find="/", Replace="slash", RecursiveReplace=False)
txt_3 = Text(rep_8)
txt_4 = ClusterOutput(txt_3)

# ==== cluster GeometryPreview: semio styled preview of geometry.
geo = ClusterInput()
swatch = ColourSwatch(SwatchColor=RGB(255, 255, 255))
swatch_2 = ColourSwatch(SwatchColor=RGB(0, 0, 0))
geo_2 = Geometry(flatten(geo))
dispatch = CSharpScript(D=geo_2)  # -> P, C, B, M, R
# ---------- dispatch: C# ----------
// Grasshopper Script Instance
#region Usings
using System;
using System.Linq;
using System.Collections;
using System.Collections.Generic;
using System.Drawing;

using Rhino;
using Rhino.Geometry;

using Grasshopper;
using Grasshopper.Kernel;
using Grasshopper.Kernel.Data;
using Grasshopper.Kernel.Types;
#endregion

public class Script_Instance : GH_ScriptInstance
{
    #region Notes
    /* 
      Members:
        RhinoDoc RhinoDocument
        GH_Document GrasshopperDocument
        IGH_Component Component
        int Iteration

      Methods (Virtual & overridable):
        Print(string text)
        Print(string format, params object[] args)
        Reflect(object obj)
        Reflect(object obj, string method_name)
    */
    #endregion

    private void RunScript(
	object D,
	ref object P,
	ref object C,
	ref object B,
	ref object M,
	ref object R)
    {
        if (
            D is Rhino.Geometry.Point ||
            D is PointCloud
            )
            P = D; // Point
        else if ( D is Mesh) M = D; // Mesh
        else if (
            D is Surface ||
            D is Extrusion ||
            D is SubD ||
            D is Brep
            )
            B = D; // Brep
        else R = D; // Rest
            
    }
}
# ---------- end dispatch ----------
debrep = DeconstructBrep(Brep=dispatch.B)  # -> Faces, Edges, Vertices
preview = CustomPreview(Geometry=flatten(dispatch.P), Material=swatch_2)
preview_2 = CustomPreview(Geometry=flatten(dispatch.C), Material=swatch_2)
preview_3 = CustomPreview(Geometry=flatten(debrep.Faces), Material=swatch)
preview_4 = CustomPreview(Geometry=flatten(debrep.Edges), Material=swatch_2)
preview_5 = CustomPreview(Geometry=flatten(dispatch.M), Material=swatch)

# ==== cluster ReplaceType: Replace a type (name) in a design. All variants stay the same and must exist in the new type.
new_na = ClusterInput()
dn = ClusterInput()
old_na = ClusterInput()
new_na_2 = Text(new_na)
dn_2 = Design(dn)
old_na_2 = Text(old_na)
dsn = ModelDesign(Design=dn_2)  # -> Design, Valid, Name, Description, Icon, Image, Variant, View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
trim = TrimTree(Tree=dsn.Pieces, Depth=1)
lng = ListLength(List=trim)
pce = ModelPiece(Piece=trim)  # -> Piece, Valid, Id, TypeName, TypeVariant, Plane, DiagramPoint
series = Series(Start=0, Step=1, Count=lng)
trim_2 = TrimTree(Tree=series, Depth=1)
expression = Expression(x=pce.TypeName, y=old_na_2, Expression="x=y")
dispatch = Dispatch(List=pce.Piece, DispatchPattern=expression)  # -> ListA, ListB
dispatch_2 = Dispatch(List=trim_2, DispatchPattern=expression)  # -> ListA, ListB
pce_2 = ModelPiece(Piece=dispatch.ListA, TypeName=new_na_2)  # -> Piece, Valid, Id, TypeName, TypeVariant, Plane, DiagramPoint
replace = ReplaceItems(List=trim, Item=pce_2.Piece, Indices=dispatch_2.ListA, Wrap=False)
trim_3 = TrimTree(Tree=replace, Depth=1)
dsn_2 = ModelDesign(Design=dsn.Design, Pieces=trim_3)  # -> Design, Valid, Name, Description, Icon, Image, Variant, View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
dn_3 = Design(dsn_2.Design)
dn_4 = ClusterOutput(dn_3)

# ==== cluster BakeDesign: Bake a design to the current Rhino document. It flattens all the pieces, selecting only representations with the same mime, lod and tags and export them as blocks.
ty = ClusterInput()
dn = ClusterInput()
mm = ClusterInput()
lod = ClusterInput()
tags = ClusterInput()
R = ClusterInput()
ty_2 = Type(ty)
mm_2 = Mime(mm)
tags_2 = Tags(tags)
dn_2 = Design(dn)
lod_2 = Lod(lod)
R_2 = Boolean(R)
shwdsn = ShowDesign_3(dn=dn_2, ty=ty_2, mm=mm_2, lod=lod_2, tags=tags_2)  # -> id_2, ur_2, pa_ur_2, pln_2
geo = LoadGeometry(run=R_2)  # -> object_4, col_2, shader_2
block_definition = ModelBlockDefinition()  # -> BlockDefinition, Objects, Name
id = Id()
ur = Url()
pa_ur = Url()
pln = Plane()
id_2 = ClusterOutput(id)
ur_2 = ClusterOutput(ur)
pa_ur_2 = ClusterOutput(pa_ur)
pln_2 = ClusterOutput(pln)

# ==== cluster JaccardIndex_2: Compute the Jaccard Index of two sets.
set1 = ClusterInput()
set2 = ClusterInput()
set1_2 = Data(set1)
set2_2 = Data(set2)
lng = ListLength(List=flatten(set1_2))
cset = CreateSet(List=set2_2)  # -> Set, Map
cset_2 = CreateSet(List=set1_2)  # -> Set, Map
intersection = SetIntersection(SetA=cset_2.Set, SetB=cset.Set)
expression = Expression(x=lng, Expression="x=0")
sunion = SetUnion(SetA=cset_2.Set, SetB=cset.Set)
null = NullItem(Item=lng)  # -> NullFlags, InvalidFlags, Description
lng_2 = ListLength(List=intersection)
lng_3 = ListLength(List=sunion)
or = GateOr(A=null.NullFlags, B=expression)
better_filter = BetterFilter(i=or, a=lng_2, b="0")  # -> R; inputs i: tree of Int32, a: tree, b: tree, c: tree, d: tree
# ---------- better_filter: C# ----------
// Grasshopper Script Instance
#region Usings
using System;
using System.Linq;
using System.Collections;
using System.Collections.Generic;
using System.Drawing;

using Rhino;
using Rhino.Geometry;

using Grasshopper;
using Grasshopper.Kernel;
using Grasshopper.Kernel.Data;
using Grasshopper.Kernel.Types;
#endregion

public class Script_Instance : GH_ScriptInstance
{
    private void RunScript(
	DataTree<int> i,
	DataTree<object> a,
	DataTree<object> b,
	DataTree<object> c,
	DataTree<object> d,
	ref object R)
    {
        foreach (var branch in i.Branches)
        {
            foreach (var index in branch)
            {
                switch (index)
                {
                    case 0:
                        R = a;
                        break;
                    case 1:
                        R = b;
                        break;
                    case 2:
                        R = c;
                        break;
                    case 3:
                        R = d;
                        break;
                    default:
                        throw new ArgumentOutOfRangeException(nameof(i), "Invalid value for i");
                }
            }
            
        }
       
    }
}
# ---------- end better_filter ----------
division = Division(A=better_filter, B=lng_3)
N = Number(division)
N_2 = ClusterOutput(N)

# ==== cluster InterpolateDesigns: Interpolate between a source design and a target design. The target will act as a blueprint. The result is an interpolated union design and two unmodified but filtered difference design. Piece planes and connection values are linearly interpolated.
T = ClusterInput()
S = ClusterInput()
t = ClusterInput()
T_2 = Design(T)
S_2 = Design(S)
t_2 = Number(t)
dsn = NormalizeDesign_2(dn=T_2)
dsn_2 = NormalizeDesign_2(dn=S_2)
dsn_3 = ModelDesign(Design=dsn)  # -> Design, Valid, Name, Description, Icon, Image, Variant, View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
dsn_4 = ModelDesign(Design=dsn_2)  # -> Design, Valid, Name, Description, Icon, Image, Variant, View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
trim = TrimTree(Tree=dsn_4.Pieces, Depth=1)
trim_2 = TrimTree(Tree=dsn_4.Connections, Depth=1)
trim_3 = TrimTree(Tree=dsn_3.Connections, Depth=1)
trim_4 = TrimTree(Tree=dsn_3.Pieces, Depth=1)
con = ModelConnection(Connection=trim_3)  # -> Connection, Valid, ConnectedPieceId, ConnectedPieceTypePortId, ConnectingPieceId, ConnectingPieceTypePortId, Rotation, Tilt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
pce = ModelPiece(Piece=trim_4)  # -> Piece, Valid, Id, TypeName, TypeVariant, Plane, DiagramPoint
con_2 = ModelConnection(Connection=trim_2)  # -> Connection, Valid, ConnectedPieceId, ConnectedPieceTypePortId, ConnectingPieceId, ConnectingPieceTypePortId, Rotation, Tilt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
pce_2 = ModelPiece(Piece=trim)  # -> Piece, Valid, Id, TypeName, TypeVariant, Plane, DiagramPoint
intersection = SetIntersection(SetA=pce_2.Id, SetB=pce.Id)
difference = SetDifference(SetA=pce.Id, SetB=pce_2.Id)
difference_2 = SetDifference(SetA=pce_2.Id, SetB=pce.Id)
selcon = SelectConnection(co=trim_3, cdpc=graft(con_2.ConnectedPieceId), cgpc=graft(con_2.ConnectingPieceId))
selcon_2 = SelectConnection(co=trim_2, cdpc=graft(con.ConnectedPieceId), cgpc=graft(con.ConnectingPieceId))
selpce = SelectPiece(pc=pce.Piece, id=graft(intersection))
selpce_2 = SelectPiece(pc=pce.Piece, id=graft(difference))
selpce_3 = SelectPiece(pc=pce_2.Piece, id=graft(difference_2))
selpce_4 = SelectPiece(pc=pce_2.Piece, id=graft(intersection))
trim_5 = TrimTree(Tree=selcon, Depth=1)
trim_6 = TrimTree(Tree=selcon_2, Depth=1)
trim_7 = TrimTree(Tree=selpce_2, Depth=1)
trim_8 = TrimTree(Tree=selpce, Depth=1)
trim_9 = TrimTree(Tree=selpce_4, Depth=1)
trim_10 = TrimTree(Tree=selpce_3, Depth=1)
con_3 = ModelConnection(Connection=trim_6)  # -> Connection, Valid, ConnectedPieceId, ConnectedPieceTypePortId, ConnectingPieceId, ConnectingPieceTypePortId, Rotation, Tilt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
con_4 = ModelConnection(Connection=trim_5)  # -> Connection, Valid, ConnectedPieceId, ConnectedPieceTypePortId, ConnectingPieceId, ConnectingPieceTypePortId, Rotation, Tilt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
expression = Expression(x=t_2, Expression="1-x")
pce_3 = ModelPiece(Piece=trim_9)  # -> Piece, Valid, Id, TypeName, TypeVariant, Plane, DiagramPoint
pce_4 = ModelPiece(Piece=trim_8)  # -> Piece, Valid, Id, TypeName, TypeVariant, Plane, DiagramPoint
merge = Merge(Data1=expression, Data2=t_2)
expression_2 = Expression(x=con_3.Rotation, y=con_4.Rotation, Expression="If(Abs(x-y)≤180,y,-(360-y))")
expression_3 = Expression(x=con_3.Tilt, y=con_4.Tilt, Expression="If(Abs(x-y)≤180,y,-(360-y))")
merge_2 = Merge(Data1=graft(pce_3.Plane), Data2=graft(pce_4.Plane))
concat = Concatenate(FragmentA=dsn_3.Name, FragmentE=",", FragmentF=dsn_3.Variant)
concat_2 = Concatenate(FragmentA=dsn_4.Name, FragmentE=",", FragmentF=dsn_4.Variant)
avgpl = AveragePlane(Pl=merge_2, M=merge)  # -> AvPl; inputs Pl: list of Plane, M: list of Double
# ---------- avgpl: C# usings ----------
using System.Linq;
# ---------- avgpl: C# ----------
    //Author: Ueli Saluz
    //Last modified: 29.05.2020
    //Contact: usaluz@outlook.de

    if (Component.RunCount < 2)
    {
      Component.Name = "AveragePlane";
      Component.NickName = "AvgPl";
      Component.Description = "Get the average plane from a set of planes. Provide multiplier to weight some planes more.";

      Component.Params.Input[0].Name = "Planes";
      Component.Params.Input[0].Description = "Planes to take average from.";
      Component.Params.Input[1].Name = "weights";
      Component.Params.Input[1].Description = "weights act like weights towards a plane.";

      Component.Params.Output[0].Name = "AveragePlane";
      Component.Params.Output[0].Description = "Resulting average plane.";

      Component.Message = "VER 1.0";
    }
    AvPl = GetAveragePlane(Pl.ToArray(), M.ToArray());
# ---------- avgpl: C# additional code ----------
  /// <summary>
  /// Gets the average plane from a set of of planes. Each plane can have a weight.
  /// </summary>
  /// <param name="planes"></param>
  /// <param name="weights"></param>
  /// <returns>Average plane under consideration of weights</returns>
  public Plane GetAveragePlane(Plane[] planes, double[] weights)
  {
    //If there are less weights than planes then the weight of 1 is assumed.
    if (weights.Length < planes.Length)
      weights = weights.Concat(Enumerable.Repeat(1d, planes.Length - weights.Length)).ToArray();
    //If there are more weights than planes then the last ones will be ignored.
    else if (weights.Length > planes.Length)
      weights = weights.Take(planes.Length).ToArray();

    if (weights.Sum() == 0)
      weights = Enumerable.Repeat(1d, planes.Length).ToArray();

    var sum = weights.Sum();
    weights = weights.Select(x => x / sum).ToArray();

    var origins = planes.Select(x => x.Origin).ToArray();
    var xAxes = planes.Select(x => x.XAxis).ToArray();
    var yAxes = planes.Select(x => x.YAxis).ToArray();

    for (int i = 0; i < planes.Length; i++)
    {
      origins[i].Transform(new Transform(weights[i]));
      xAxes[i].Transform(new Transform(weights[i]));
      yAxes[i].Transform(new Transform(weights[i]));
    }

    return new Plane(origins.Aggregate((a,b) => a + b), xAxes.Aggregate((a,b) => a + b), yAxes.Aggregate((a,b) => a + b));
  }
# ---------- end avgpl ----------
concat_3 = Concatenate(FragmentA=concat, FragmentB="(", FragmentD=")")
concat_4 = Concatenate(FragmentD=")")
expression_4 = Expression(x=t_2, Expression="x≥0.5")
c_script = CSharpScript(x=avgpl)  # -> a; inputs x: Plane
# ---------- c_script: C# ----------
// Grasshopper Script Instance
#region Usings
using System;
using System.Linq;
using System.Collections;
using System.Collections.Generic;
using System.Drawing;

using Rhino;
using Rhino.Geometry;

using Grasshopper;
using Grasshopper.Kernel;
using Grasshopper.Kernel.Data;
using Grasshopper.Kernel.Types;
#endregion

public class Script_Instance : GH_ScriptInstance
{
    #region Notes
    /* 
      Members:
        RhinoDoc RhinoDocument
        GH_Document GrasshopperDocument
        IGH_Component Component
        int Iteration

      Methods (Virtual & overridable):
        Print(string text)
        Print(string format, params object[] args)
        Reflect(object obj)
        Reflect(object obj, string method_name)
    */
    #endregion

    private void RunScript(Plane x, ref object a)
    {
        a = x.IsValid ? x : null;
    }
}
# ---------- end c_script ----------
filter = StreamFilter(Gate=expression_4, Stream0=pce_3.Piece, Stream1=pce_4.Piece)
concat_5 = Concatenate(FragmentA=concat_2, FragmentB=" U ", FragmentC=concat)
concat_6 = Concatenate(FragmentA=concat_2, FragmentB=" \ ", FragmentC=concat)
concat_7 = Concatenate(FragmentA=concat_2, FragmentB=" \ ", FragmentC=concat)
trim_11 = TrimTree(Tree=c_script, Depth=1)
merge_3 = Merge(Data1=graft(con_3.Gap), Data2=graft(con_4.Gap))
merge_4 = Merge(Data1=graft(con_3.Shift), Data2=graft(con_4.Shift))
merge_5 = Merge(Data1=graft(con_3.Tilt), Data2=graft(expression_3))
merge_6 = Merge(Data1=graft(con_3.Rotation), Data2=graft(expression_2))
tstat = TreeStatistics(Tree=selcon_2)  # -> Paths, Length, Count
tstat_2 = TreeStatistics(Tree=selcon)  # -> Paths, Length, Count
pce_5 = ModelPiece(Piece=filter, Plane=trim_11)  # -> Piece, Valid, Id, TypeName, TypeVariant, Plane, DiagramPoint
trim_12 = TrimTree(Tree=tstat_2.Length, Depth=1)
trim_13 = TrimTree(Tree=tstat.Length, Depth=1)
concat_8 = Concatenate(FragmentA=t_2, FragmentB=",", FragmentC=expression)
interp = InterpolateData(Data=merge_6, Parameter=t_2, Interpolation=2)
interp_2 = InterpolateData(Data=merge_3, Parameter=t_2, Interpolation=2)
interp_3 = InterpolateData(Data=merge_4, Parameter=t_2, Interpolation=2)
interp_4 = InterpolateData(Data=merge_5, Parameter=t_2, Interpolation=2)
filter_2 = StreamFilter(Gate=expression_4, Stream0=con_3.Connection, Stream1=con_4.Connection)
pc_s_u_t = Piece(pce_5.Piece)
pc_t_s = Piece(trim_7)
pc_s_t = Piece(trim_10)
trim_14 = TrimTree(Tree=interp_3, Depth=1)
equals = Equality(FirstNumber=trim_13, SecondNumber="0")  # -> Equality, Inequality
trim_15 = TrimTree(Tree=interp, Depth=1)
trim_16 = TrimTree(Tree=interp_4, Depth=1)
equals_2 = Equality(FirstNumber=trim_12, SecondNumber="0")  # -> Equality, Inequality
trim_17 = TrimTree(Tree=interp_2, Depth=1)
con_5 = ModelConnection(Connection=filter_2, Rotation=trim_15, Tilt=trim_16, Gap=trim_17, Shift=trim_14)  # -> Connection, Valid, ConnectedPieceId, ConnectedPieceTypePortId, ConnectingPieceId, ConnectingPieceTypePortId, Rotation, Tilt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
cull = CullPattern(List=trim_2, CullPattern=equals_2.Equality)
cull_2 = CullPattern(List=trim_3, CullPattern=equals.Equality)
co_s_u_t = Connection(con_5.Connection)
co_s_t = Connection(cull)
co_t_s = Connection(cull_2)
dsn_5 = ModelDesign(Name=concat_6, Pieces=pc_s_t, Connections=co_s_t)  # -> Design, Valid, Name, Description, Icon, Image, Variant, View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
dsn_6 = ModelDesign(Name=concat_7, Pieces=pc_t_s, Connections=co_t_s)  # -> Design, Valid, Name, Description, Icon, Image, Variant, View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
dsn_7 = ModelDesign(Name=concat_5, Variant=concat_8, Pieces=pc_s_u_t, Connections=co_s_u_t)  # -> Design, Valid, Name, Description, Icon, Image, Variant, View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
dn_s_u_t = Design(dsn_7.Design)
dn_s_t = Design(dsn_5.Design)
dn_t_s = Design(dsn_6.Design)
dn_s_t_2 = ClusterOutput(dn_s_t)
dn_s_u_t_2 = ClusterOutput(dn_s_u_t)
dn_t_s_2 = ClusterOutput(dn_t_s)

# ==== cluster ShowDesign_4: Show a design by flattening it and selecting representations based on mime and tags. See Select Representations for details of the representation query.
ty = ClusterInput()
dn = ClusterInput()
mm = ClusterInput()
tags = ClusterInput()
ty_2 = Type(ty)
mm_2 = Mime(mm)
tags_2 = Tags(tags)
dn_2 = Design(dn)
fltdsn = FlattenDesign(Design=dn_2, Type=ty_2)
dsn = ModelDesign(Design=fltdsn)  # -> Design, Valid, Name, Description, Icon, Image, Variant, View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
typ = ModelType(Type=ty_2)  # -> Type, Valid, Name, Description, Icon, Image, Variant, Unit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
trim = TrimTree(Tree=dsn.Pieces, Depth=1)
tstat = TreeStatistics(Tree=typ.Representations)  # -> Paths, Length, Count
pce = ModelPiece(Piece=trim)  # -> Piece, Valid, Id, TypeName, TypeVariant, Plane, ScreenPoint
expression = Expression(x=graft(pce.TypeName), y=typ.Name, Expression="x=y")
expression_2 = Expression(x=graft(pce.TypeVariant), y=typ.Variant, Expression="x=y")
and = GateAnd(A=expression, B=expression_2)
cull = CullPattern(List=ty_2, CullPattern=and)
lng = ListLength(List=ty_2)
txt = Text(cull)
series = Series(Start=0, Step=1, Count=lng)
txt_2 = Text(ty_2)
expression_3 = Expression(x=txt, y=txt_2, Expression="x=y")
trim_2 = TrimTree(Tree=series, Depth=1)
cull_2 = CullPattern(List=trim_2, CullPattern=expression_3)
trim_3 = TrimTree(Tree=cull_2, Depth=1)
item = ListItem(List=tstat.Paths, Index=trim_3, Wrap=True)
branch = TreeBranch(Tree=typ.Representations, Path=item, MaintainPaths=False)
mrg_p = MergeSeperatlyPrepend(x=branch)  # -> Mrgd; inputs x: tree; same code as mrg_p
rep = SelectRepresentation(rp=mrg_p, mm=mm_2, tags=tags_2)  # -> rp_5, ur_2, pa_ur_2
trim_4 = TrimTree(Tree=rep.ur_2, Depth=1)
trim_5 = TrimTree(Tree=rep.pa_ur_2, Depth=1)
id = Id(pce.Id)
ur = Url(trim_4)
pa_ur = Url(trim_5)
pln = Plane(pce.Plane)
id_2 = ClusterOutput(id)
ur_2 = ClusterOutput(ur)
pa_ur_2 = ClusterOutput(pa_ur)
pln_2 = ClusterOutput(pln)

# ==== cluster SelectRepresentation: Select exactly one representation based on mime and tags. The tag matching is based on the Jaccard index. If the mime type is not given or does not exist, then all representations are used to search for closest match. If decisions rank equally hight always the first representation is picked.
mm = ClusterInput()
tags = ClusterInput()
rp = ClusterInput()
rp_2 = Representation(rp)
mm_2 = Mime(mm)
tags_2 = Tags(tags)
l2o = List2Object(L=rp_2)  # -> O; inputs L: tree
# ---------- l2o: Python ----------
#Component Information
#--------------------------------------------------------------------------------------------
if ghenv.Component.RunCount<2:
    #General
    #--------------------------------------------------------------------------------------------
    __author__ = "Ueli Saluz"
    __version__ = "2022.04.24"
    
    ghenv.Component.Name = "List2Object"
    ghenv.Component.NickName = "L2O"
    ghenv.Component.Description = "Wraps a list of objects into a list object."
    ghenv.Component.Message = "VER 1.0"
    ghenv.Component.Category = "Sets"
    ghenv.Component.SubCategory = "Tree"
    
     #Inputs
    #--------------------------------------------------------------------------------------------
    inputIndex=0
    
    ghenv.Component.Params.Input[inputIndex].Name = "List"
    ghenv.Component.Params.Input[inputIndex].NickName = "L"
    ghenv.Component.Params.Input[inputIndex].Description = "Tree with lists to wrap."
    ghenv.Component.Params.Input[inputIndex].Optional = False
    inputIndex+=1
    

    #Outputs
    #--------------------------------------------------------------------------------------------
    outputIndex=0
    
    ghenv.Component.Params.Output[outputIndex].Name =  "ListObject" 
    ghenv.Component.Params.Output[outputIndex].NickName = "O"
    ghenv.Component.Params.Output[outputIndex].Description = "Python list object as single item."
    outputIndex+=1


#Imports
#--------------------------------------------------------------------------------------------
from System import Object
from Grasshopper import DataTree

#Solver - Run with trees to enhance performance drastically
#--------------------------------------------------------------------------------------------
if __name__ == "__main__":
    
    #Initialize trees
    #--------------------------------------------------------------------------------------------
    TreeToWrap = DataTree[Object]()
    
    #Data matching
    #--------------------------------------------------------------------------------------------
    for path in L.Paths:
        listBranch = L.Branch(path)
        TreeToWrap.Add(listBranch,path)
    
     #Assign trees to output
    #--------------------------------------------------------------------------------------------
    O = TreeToWrap
# ---------- end l2o ----------

rep = ModelRepresentation(Representation=graft(rp_2))  # -> Representation, Valid, Url, Mime, Tags
lng = ListLength(List=mm_2)
expression = Expression(x=rep.Mime, y=mm_2, Expression="x=y")
null = NullItem(Item=lng)  # -> NullFlags, InvalidFlags, Description
expression_2 = Expression(x=lng, Expression="x=0")
ma = MassAddition(Input=expression)  # -> Result, PartialResults
or = GateOr(A=expression_2, B=null.NullFlags)
cull = CullPattern(List=rep.Representation, CullPattern=ma.Result)
trim = TrimTree(Tree=cull, Depth=1)
mime_match = Representation(trim)
nulltobranch = CSharpScript(D=mime_match)  # -> R; inputs D: tree
# ---------- nulltobranch: C# ----------
#region Usings
using System;
using System.Linq;
using System.Collections;
using System.Collections.Generic;
using System.Drawing;

using Rhino;
using Rhino.Geometry;

using Grasshopper;
using Grasshopper.Kernel;
using Grasshopper.Kernel.Data;
using Grasshopper.Kernel.Types;
#endregion

public class Script_Instance : GH_ScriptInstance
{

    private void RunScript(DataTree<object> D, ref object R)
    {
        foreach (GH_Path path in D.Paths)
            if (D.Branch(path).Count == 0)
                D.Add(null, path);

        R = D;
    }
}
# ---------- end nulltobranch ----------
nullrep = ReplaceNulls(Items=nulltobranch, Replacements=l2o)  # -> graft(Items), Count

panel = Panel(nullrep.Items)
o2l = Object2List(O=nullrep.Items)  # -> L; inputs O: tree
# ---------- o2l: Python ----------
# Component Information
# --------------------------------------------------------------------------------------------
if ghenv.Component.RunCount < 2:
    # General
    # --------------------------------------------------------------------------------------------
    __author__ = "Ueli Saluz"
    __version__ = "2025.02.19"

    ghenv.Component.Name = "Object2List"
    ghenv.Component.NickName = "O2L"
    ghenv.Component.Description = "Unwraps a list of objects into a list object and returns the object if it is not iterable."
    ghenv.Component.Message = "VER 1.1"
    ghenv.Component.Category = "Sets"
    ghenv.Component.SubCategory = "Tree"

    # Inputs
    # --------------------------------------------------------------------------------------------
    inputIndex = 0

    ghenv.Component.Params.Input[inputIndex].Name = "ListObject"
    ghenv.Component.Params.Input[inputIndex].NickName = "O"
    ghenv.Component.Params.Input[inputIndex].Description = "A python list object that will be unwrapped into a Grasshopper list or returned as is if not iterable."
    ghenv.Component.Params.Input[inputIndex].Optional = False
    inputIndex += 1

    # Outputs
    # --------------------------------------------------------------------------------------------
    outputIndex = 0

    ghenv.Component.Params.Output[outputIndex].Name = "List"
    ghenv.Component.Params.Output[outputIndex].NickName = "L"
    ghenv.Component.Params.Output[outputIndex].Description = "The unwrapped list."
    outputIndex += 1

# Imports
# --------------------------------------------------------------------------------------------
from System import Object
from Grasshopper import DataTree
from collections import Iterable

# Solver - Run with trees to enhance performance drastically
# --------------------------------------------------------------------------------------------
if __name__ == "__main__":

    # Initialize trees
    # --------------------------------------------------------------------------------------------
    OriginalTree = DataTree[Object]()

    # Data matching
    # --------------------------------------------------------------------------------------------
    for path in O.Paths:
        listBranch = O.Branch(path)
        for i, listItem in enumerate(listBranch):
            if isinstance(listItem, Iterable) and not isinstance(listItem, str):
                OriginalTree.AddRange(list(listItem), path.AppendElement(i))
            else:
                OriginalTree.Add(listItem, path.AppendElement(i))

    # Assign trees to output
    # --------------------------------------------------------------------------------------------
    L = OriginalTree
# ---------- end o2l ----------
l2o_2 = List2Object(L=mime_match)  # -> O; inputs L: tree; same code as l2o
trim_2 = TrimTree(Tree=o2l, Depth=1)
trim_3 = TrimTree(Tree=trim_2, Depth=1)

filter = StreamFilter(Gate=or, Stream0=trim_3, Stream1=rp_2)
rp_3 = Representation(filter)

rep_2 = ModelRepresentation(Representation=rp_3)  # -> Representation, Valid, Url, Mime, Tags
jac = JaccardIndex(set1=tags_2, set2=rep_2.Tags)
trim_4 = TrimTree(Tree=jac, Depth=1)
minmax = MinimumMaximum(L=trim_4)  # -> Max, MaxI, Min, MinI; inputs L: list
# ---------- minmax: Python ----------
#Component Information
#--------------------------------------------------------------------------------------------
if ghenv.Component.RunCount<2:
    #General
    #--------------------------------------------------------------------------------------------
    __author__ = "Ueli Saluz"
    __version__ = "2022.04.22"
    
    ghenv.Component.Name = "MinimumMaximum"
    ghenv.Component.NickName = "MinMax"
    ghenv.Component.Description = "Returns the maximum and mininum of a list and their corresponding index."
    ghenv.Component.Message = "VER 1.0"
    ghenv.Component.Category = "Maths"
    ghenv.Component.SubCategory = "Util"
    
     #Inputs
    #--------------------------------------------------------------------------------------------
    inputIndex=0
    
    ghenv.Component.Params.Input[inputIndex].Name = "L"
    ghenv.Component.Params.Input[inputIndex].NickName = "L"
    ghenv.Component.Params.Input[inputIndex].Description = "A list of numbers."
    ghenv.Component.Params.Input[inputIndex].Optional = False
    inputIndex+=1
    
    
    #Outputs
    #--------------------------------------------------------------------------------------------
    outputIndex=0
    
    ghenv.Component.Params.Output[outputIndex].Name = "Max"
    ghenv.Component.Params.Output[outputIndex].NickName = "Max"
    ghenv.Component.Params.Output[outputIndex].Description = "Maximum of the list"
    outputIndex+=1
    
    ghenv.Component.Params.Output[outputIndex].Name = "MaxI"
    ghenv.Component.Params.Output[outputIndex].NickName = "MaxI"
    ghenv.Component.Params.Output[outputIndex].Description = "Index of the maximum of the list"
    outputIndex+=1
    
    ghenv.Component.Params.Output[outputIndex].Name = "Min"
    ghenv.Component.Params.Output[outputIndex].NickName = "Min"
    ghenv.Component.Params.Output[outputIndex].Description = "Minimum of the list"
    outputIndex+=1
    
    ghenv.Component.Params.Output[outputIndex].Name = "MinI"
    ghenv.Component.Params.Output[outputIndex].NickName = "MinI"
    ghenv.Component.Params.Output[outputIndex].Description = "Index of the minimum of the list"
    outputIndex+=1


#Solver - Run with trees to enhance performance drastically
#--------------------------------------------------------------------------------------------
if __name__ == "__main__":
    
    maximum = max(L)
    MaxI = L.index(maximum)
    Max = maximum
    
    minimum = min(L)
    MinI = L.index(minimum)
    Min = minimum
# ---------- end minmax ----------
item = ListItem(List=rep_2.Representation, Index=minmax.MaxI, Wrap=True)
rep_3 = ModelRepresentation(Representation=item)  # -> Representation, Valid, Url, Mime, Lod
sep = Separator()  # -> S
# ---------- sep: C# ----------
#region Usings
using System;
using System.Linq;
using System.Collections;
using System.Collections.Generic;
using System.Drawing;
using System.IO;

using Rhino;
using Rhino.Geometry;

using Grasshopper;
using Grasshopper.Kernel;
using Grasshopper.Kernel.Data;
using Grasshopper.Kernel.Types;
#endregion

public class Script_Instance : GH_ScriptInstance
{
    private void RunScript(ref object S)
    {
        S = Path.DirectorySeparatorChar;
    }
}
# ---------- end sep ----------
rep_4 = ReplaceText(Text=rep_3.Url, Find="/", Replace=sep, RecursiveReplace=False)
rp_4 = Representation(item)
pa_ur = Text(rep_4)
ur = Url(rep_3.Url)

rp_5 = ClusterOutput(rp_4)
ur_2 = ClusterOutput(ur)
pa_ur_2 = ClusterOutput(pa_ur)

# ==== cluster NormalizeType: Normalize a type for this document. This converts the length unit of the type to the length unit of this document and it scales the ports by the right scaling factor. Further it sorts the representations, ports, qualities by it's keys. The order of authors is not changed.
ty = ClusterInput()
ty_2 = Type(graft(ty))
typ = ModelType()  # -> Type, Valid, Name, Description, Icon, Image, Variant, Unit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
typ_2 = ModelType(Type=ty_2)  # -> Type, Valid, Name, Description, Icon, Image, Variant, Unit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
cnvunt = ConvertUnit(Value=1, FromUnit=typ_2.Unit, ToUnit=typ.Unit)
trim = TrimTree(Tree=typ_2.Ports, Depth=1)
trim_2 = TrimTree(Tree=typ_2.Representations, Depth=1)
trim_3 = TrimTree(Tree=typ_2.Qualities, Depth=1)
rep = ModelRepresentation(Representation=trim_2)  # -> Representation, Valid, Url, Mime, Lod
por = ModelPort(Port=trim)  # -> Port, Valid, Id, Point, Direction, Locators, Locators_2, T
qal = ModelQuality(Quality=trim_3)  # -> Quality, Valid, Name, Value, Unit, Definition
scale = Scale(Geometry=por.Point, Center=Point(0, 0, 0), Factor=cnvunt)  # -> Geometry, Transform
concat = Concatenate(FragmentA=rep.Mime, FragmentC="##", FragmentB=rep.Lod)
scale_2 = Scale(Geometry=por.Direction, Center=Point(0, 0, 0), Factor=cnvunt)  # -> Geometry, Transform
join = TextJoin(Text=<missing>, Join="##")
tsort = SortText(Keys=qal.Name, Values=qal.Quality, Culture=127)  # -> Keys, Values
por_2 = ModelPort(Port=por.Port, Point=scale.Geometry, Direction=scale_2.Geometry)  # -> Port, Valid, Id, Point, Direction, Locators, Locators_2, T
concat_2 = Concatenate(FragmentA=graft(concat), FragmentB=join)
trim_4 = TrimTree(Tree=tsort.Values, Depth=1)
trim_5 = TrimTree(Tree=concat_2, Depth=1)
tsort_2 = SortText(Keys=por_2.Id, Values=por_2.Port, Culture=127)  # -> Keys, Values
trim_6 = TrimTree(Tree=tsort_2.Values, Depth=1)
tsort_3 = SortText(Keys=trim_5, Values=rep.Representation, Culture=127)  # -> Keys, Values
trim_7 = TrimTree(Tree=tsort_3.Values, Depth=1)
typ_3 = ModelType(Type=typ_2.Type, Unit=typ.Unit, Representations=trim_7, Ports=trim_6, Qualities=trim_4)  # -> Type, Valid, Name, Description, Icon, Image, Variant, Unit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
trim_8 = TrimTree(Tree=typ_3.Type, Depth=1)
ty_3 = Type(trim_8)
ty_4 = ClusterOutput(ty_3)

# ==== cluster NormalizeDesign_2: Normalize a design for this document. This includes changing the unit to the document unit and rescaling the affected values. Further it reoders pieces, connections and qualities. Connections might be swapped, so that the connected piece id is lexically first. The order of authors is not changed.
dn = ClusterInput()
dn_2 = Design(graft(dn))
dsn = ModelDesign()  # -> Design, Valid, Name, Description, Icon, Image, Variant, View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
dsn_2 = ModelDesign(Design=dn_2)  # -> Design, Valid, Name, Description, Icon, Image, Variant, View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
trim = TrimTree(Tree=dsn_2.Pieces, Depth=1)
trim_2 = TrimTree(Tree=dsn_2.Qualities, Depth=1)
trim_3 = TrimTree(Tree=dsn_2.Connections, Depth=1)
cnvunt = ConvertUnit(Value=1, FromUnit=dsn_2.Unit, ToUnit=dsn.Unit)
con = ModelConnection(Connection=trim_3)  # -> Connection, Valid, ConnectedPieceId, ConnectedPieceTypePortId, ConnectingPieceId, ConnectingPieceTypePortId, Rotation, Tilt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
multiplication = Multiplication(A=con.Gap, B=cnvunt)
multiplication_2 = Multiplication(A=con.Shift, B=cnvunt)
con_2 = ModelConnection(Connection=con.Connection, Gap=multiplication, Shift=multiplication_2)  # -> Connection, Valid, ConnectedPieceId, ConnectedPieceTypePortId, ConnectingPieceId, ConnectingPieceTypePortId, Rotation, Tilt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
merge = Merge(Data1=graft(con_2.ConnectedPieceId), Data2=graft(con_2.ConnectingPieceId))
tsort = SortText(Keys=merge, Culture=127)  # -> Keys, Values
trim_4 = TrimTree(Tree=tsort.Keys, Depth=1)
expression = Expression(x=merge, y=trim_4, Expression="x=y")
item = ListItem(List=expression, Index=0, Wrap=True)
trim_5 = TrimTree(Tree=item, Depth=1)
dispatch = Dispatch(List=con_2.Connection, DispatchPattern=trim_5)  # -> ListA, ListB
con_3 = ModelConnection(Connection=dispatch.ListB)  # -> Connection, Valid, ConnectedPieceId, ConnectedPieceTypePortId, ConnectingPieceId, ConnectingPieceTypePortId, Rotation, Tilt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
con_4 = ModelConnection(
    Connection=dispatch.ListB,
    ConnectedPieceId=con_3.ConnectingPieceId,
    ConnectedPieceTypePortId=con_3.ConnectingPieceTypePortId,
    ConnectingPieceId=con_3.ConnectedPieceId,
    ConnectingPieceTypePortId=con_3.ConnectedPieceTypePortId)  # -> Connection, Valid, ConnectedPieceId, ConnectedPieceTypePortId, ConnectingPieceId, ConnectingPieceTypePortId, Rotation, Tilt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
merge_2 = Merge(Data1=dispatch.ListA, Data2=con_4.Connection)
con_5 = ModelConnection(Connection=merge_2)  # -> Connection, Valid, ConnectedPieceId, ConnectedPieceTypePortId, ConnectingPieceId, ConnectingPieceTypePortId, Rotation, Tilt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
concat = Concatenate(FragmentA=con_5.ConnectedPieceId, FragmentC="##", FragmentB=con_5.ConnectingPieceId)
pce = ModelPiece(Piece=trim)  # -> Piece, Valid, Id, TypeName, TypeVariant, Plane, ScreenPoint
qal = ModelQuality(Quality=trim_2)  # -> Quality, Valid, Name, Value, Unit, Definition
tsort_2 = SortText(Keys=concat, Values=con_5.Connection, Culture=127)  # -> Keys, Values
tsort_3 = SortText(Keys=qal.Name, Values=qal.Quality, Culture=127)  # -> Keys, Values
tsort_4 = SortText(Keys=pce.Id, Values=pce.Piece, Culture=127)  # -> Keys, Values
trim_6 = TrimTree(Tree=tsort_2.Values, Depth=1)
trim_7 = TrimTree(Tree=tsort_3.Values, Depth=1)
trim_8 = TrimTree(Tree=tsort_4.Values, Depth=1)
dsn_3 = ModelDesign(Design=dsn_2.Design, Unit=dsn.Unit, Pieces=trim_8, Connections=trim_6, Qualities=trim_7)  # -> Design, Valid, Name, Description, Icon, Image, Variant, View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
trim_9 = TrimTree(Tree=dsn_3.Design, Depth=1)
dn_3 = Design(trim_9)
dn_4 = ClusterOutput(dn_3)

# ==== cluster ShowDesign_3: Show a design by flattening it and selecting only representations with the same mime, lod and tags.
ty = ClusterInput()
dn = ClusterInput()
mm = ClusterInput()
lod = ClusterInput()
tags = ClusterInput()
ty_2 = Type(ty)
mm_2 = Mime(mm)
tags_2 = Tags(tags)
dn_2 = Design(dn)
lod_2 = Lod(lod)
fltdsn = FlattenDesign(Design=dn_2, Type=ty_2)
dsn = ModelDesign(Design=fltdsn)  # -> Design, Valid, Name, Description, Icon, Image, Variant, View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
typ = ModelType(Type=ty_2)  # -> Type, Valid, Name, Description, Icon, Image, Variant, Unit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
trim = TrimTree(Tree=dsn.Pieces, Depth=1)
tstat = TreeStatistics(Tree=typ.Representations)  # -> Paths, Length, Count
pce = ModelPiece(Piece=trim)  # -> Piece, Valid, Id, TypeName, TypeVariant, Plane, ScreenPoint
expression = Expression(x=graft(pce.TypeName), y=typ.Name, Expression="x=y")
expression_2 = Expression(x=graft(pce.TypeVariant), y=typ.Variant, Expression="x=y")
and = GateAnd(A=expression, B=expression_2)
cull = CullPattern(List=ty_2, CullPattern=and)
lng = ListLength(List=ty_2)
txt = Text(cull)
series = Series(Start=0, Step=1, Count=lng)
txt_2 = Text(ty_2)
expression_3 = Expression(x=txt, y=txt_2, Expression="x=y")
trim_2 = TrimTree(Tree=series, Depth=1)
cull_2 = CullPattern(List=trim_2, CullPattern=expression_3)
trim_3 = TrimTree(Tree=cull_2, Depth=1)
item = ListItem(List=tstat.Paths, Index=trim_3, Wrap=True)
branch = TreeBranch(Tree=typ.Representations, Path=item, MaintainPaths=False)
mrg_p = MergeSeperatlyPrepend(x=branch)  # -> Mrgd; inputs x: tree; same code as mrg_p
merge = Merge(Data1=mrg_p, Data2=mrg_p)
selrep = SelectRepresentation_2(rp=merge, lod=lod_2, tags=tags_2)  # -> rp_4, ur_2, pa_ur_2
trim_4 = TrimTree(Tree=selrep.ur_2, Depth=1)
trim_5 = TrimTree(Tree=selrep.pa_ur_2, Depth=1)
id = Id(pce.Id)
ur = Url(trim_4)
pa_ur = Url(trim_5)
pln = Plane(pce.Plane)
id_2 = ClusterOutput(id)
ur_2 = ClusterOutput(ur)
pa_ur_2 = ClusterOutput(pa_ur)
pln_2 = ClusterOutput(pln)

# ==== cluster SelectPiece: Select a piece with the id.
pc = ClusterInput()
id = ClusterInput()
pc_2 = Piece(pc)
id_2 = Id(id)
pce = ModelPiece(Piece=pc_2)  # -> Piece, Valid, Id, TypeName, TypeVariant, Plane, ScreenPoint
expression = Expression(x=pce.Id, y=id_2, Expression="x=y")
cull = CullPattern(List=pce.Piece, CullPattern=expression)
pc_3 = Piece(cull)
pc_4 = ClusterOutput(pc_3)

# ==== cluster SelectConnection: Select a connection with the connected id and the connected id. The connections are symetric, so if the conected is the connecting and vice versa it will still selct them.
co = ClusterInput()
cdpc = ClusterInput()
cgpc = ClusterInput()
co_2 = Connection(co)
cdpc_2 = ConnectedPieceId(cdpc)
cgpc_2 = ConnectingPieceId(cgpc)
con = ModelConnection(Connection=co_2)  # -> Connection, Valid, ConnectedPieceId, ConnectedPieceTypePortId, ConnectingPieceId, ConnectingPieceTypePortId, Rotation, Tilt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
expression = Expression(x=con.ConnectedPieceId, y=cdpc_2, Expression="x=y")
expression_2 = Expression(x=con.ConnectedPieceId, y=cgpc_2, Expression="x=y")
expression_3 = Expression(x=con.ConnectingPieceId, y=cgpc_2, Expression="x=y")
expression_4 = Expression(x=con.ConnectingPieceId, y=cdpc_2, Expression="x=y")
and = GateAnd(A=expression, B=expression_3)
and_2 = GateAnd(A=expression_2, B=expression_4)
or = GateOr(A=and, B=and_2)
cull = CullPattern(List=con.Connection, CullPattern=or)
co_3 = Connection(cull)
co_4 = ClusterOutput(co_3)

# ==== cluster JaccardIndex: Compute the Jaccard Index of two sets.
set1 = ClusterInput()
set2 = ClusterInput()
set1_2 = Data(set1)
set2_2 = Data(set2)
cset = CreateSet(List=set2_2)  # -> Set, Map
cset_2 = CreateSet(List=set1_2)  # -> Set, Map
lng = ListLength(List=set1_2)
lng_2 = ListLength(List=set2_2)
intersection = SetIntersection(SetA=cset_2.Set, SetB=cset.Set)
expression = Expression(x=lng, Expression="x=0")
expression_2 = Expression(x=lng_2, Expression="x=0")
sunion = SetUnion(SetA=cset_2.Set, SetB=cset.Set)
null = NullItem(Item=lng)  # -> NullFlags, InvalidFlags, Description
null_2 = NullItem(Item=lng_2)  # -> NullFlags, InvalidFlags, Description
lng_3 = ListLength(List=sunion)
lng_4 = ListLength(List=intersection)
or = GateOr(A=null.NullFlags, B=expression)
or_2 = GateOr(A=null_2.NullFlags, B=expression_2)
division = Division(A=lng_4, B=lng_3)
int = Integer(or)
int_2 = Integer(or_2)
concat = Concatenate(FragmentA=int, FragmentB=int_2)
b2d = BinaryToDecimal(Binary=concat)  # -> Decimal
# ---------- b2d: Python ----------
if ghenv.Component.RunCount<2:
    __author__ = "Ueli Saluz"
    __version__ = "2021.11.14"
    
    ghenv.Component.Name = "BinaryToDecimal"
    ghenv.Component.NickName = "B2D"
    ghenv.Component.Description = "Converts a number in binary representation to a number in decimal representation."
    ghenv.Component.Message = "VER 1.0"
    
    ghenv.Component.Params.Input[0].NickName = "Binary"
    
    ghenv.Component.Params.Input[0].Description = "Binary representation of a number."
    
    ghenv.Component.Params.Output[0].NickName = "Decimal"
    
    ghenv.Component.Params.Output[0].Description = "Converted decimal representation of the same number."

if __name__ == "__main__":
    Decimal = int(Binary,2)
# ---------- end b2d ----------
expression_3 = Expression(c=b2d, x=division, Expression="If(c=0,x,If(c=3,1,0))")
N = Number(expression_3)
N_2 = ClusterOutput(N)

# ==== cluster SelectRepresentation_2: Select a representation based on mime, lod and tags. The mime and lod must be equal and the tags must contain all the given tags.
rp = ClusterInput()
mm = ClusterInput()
lod = ClusterInput()
tags = ClusterInput()
rp_2 = Representation(graft(rp))
mm_2 = Mime(graft(mm))
lod_2 = Lod(graft(lod))
tags_2 = Tags(graft(tags))
rep = ModelRepresentation(Representation=rp_2)  # -> Representation, Valid, Url, Mime, Lod
expression = Expression(x=rep.Mime, y=mm_2, Expression="x=y")
expression_2 = Expression(y=rep.Mime, Expression="x=y")
cull = CullPattern(List=rep.Representation, CullPattern=expression)
null = NullItem(Item=rep.Mime)  # -> NullFlags, InvalidFlags, Description
merge = Merge(Data1=cull, Data2=rep.Representation)
or = GateOr(A=expression_2, B=null.NullFlags)
panel = Panel("True")
item = ListItem(List=merge, Index=or, Wrap=True)
panel_2 = Panel(item)
rep_2 = ModelRepresentation(Representation=item)  # -> Representation, Valid, Url, Mime, Lod
expression_3 = Expression(y=lod_2, Expression="x=y")
null_2 = NullItem(Item=lod_2)  # -> NullFlags, InvalidFlags, Description
expression_4 = Expression(x=rep_2.Lod, y=lod_2, Expression="x=y")
or_2 = GateOr(A=expression_3, B=null_2.NullFlags)
cull_2 = CullPattern(List=rep_2.Representation, CullPattern=expression_4)
rep_3 = ModelRepresentation(Representation=cull_2)  # -> Representation, Valid, Url, Mime, Lod
trim = TrimTree(Tree=<missing>, Depth=1)
contains = Contains(L=trim, I=tags_2)  # -> R; inputs L: list, I: list
# ---------- contains: Python ----------
#Component Information
#--------------------------------------------------------------------------------------------
if ghenv.Component.RunCount<2:
    #General
    #--------------------------------------------------------------------------------------------
    __author__ = "Ueli Saluz"
    __version__ = "2023.02.04"
    
    ghenv.Component.Name = "Contains"
    ghenv.Component.NickName = "Contains"
    ghenv.Component.Description = "True if list contains one of the items."
    ghenv.Component.Message = "VER 1.0"
    ghenv.Component.Category = "Set"
    ghenv.Component.SubCategory = "List"
    
     #Inputs
    #--------------------------------------------------------------------------------------------
    inputIndex=0
    
    ghenv.Component.Params.Input[inputIndex].Name = "List"
    ghenv.Component.Params.Input[inputIndex].NickName = "L"
    ghenv.Component.Params.Input[inputIndex].Description = ""
    ghenv.Component.Params.Input[inputIndex].Optional = False
    inputIndex+=1
    
    ghenv.Component.Params.Input[inputIndex].Name = "Items"
    ghenv.Component.Params.Input[inputIndex].NickName = "I"
    ghenv.Component.Params.Input[inputIndex].Description = ""
    ghenv.Component.Params.Input[inputIndex].Optional = False
    inputIndex+=1
    
    #Outputs
    #--------------------------------------------------------------------------------------------
    outputIndex=0
    
    ghenv.Component.Params.Output[outputIndex].Name = "Contains"
    ghenv.Component.Params.Output[outputIndex].NickName = "R"
    ghenv.Component.Params.Output[outputIndex].Description = ""
    outputIndex+=1

R = False
for i in I:
    if i in L:
        R = True
# ---------- end contains ----------
ma = MassAddition(Input=contains)  # -> Result, PartialResults
lng = ListLength(List=contains)
equals = Equality(FirstNumber=ma.Result, SecondNumber=lng)  # -> Equality, Inequality
cull_3 = CullPattern(List=rep_3.Representation, CullPattern=equals.Equality)
rep_4 = ModelRepresentation(Representation=cull_3)  # -> Representation, Valid, Url, Mime, Lod
curdir = CSharpScript()  # -> D, S
# ---------- curdir: C# ----------
#region Usings
using System;
using System.Linq;
using System.Collections;
using System.Collections.Generic;
using System.Drawing;
using System.IO;

using Rhino;
using Rhino.Geometry;

using Grasshopper;
using Grasshopper.Kernel;
using Grasshopper.Kernel.Data;
using Grasshopper.Kernel.Types;
#endregion

public class Script_Instance : GH_ScriptInstance
{
    private void RunScript(ref object D, ref object S)
    {
        D = Path.GetDirectoryName(this.GrasshopperDocument.FilePath);
        S = Path.DirectorySeparatorChar;
    }
}
# ---------- end curdir ----------
rep_5 = ReplaceText(Text=rep_4.Url, Find="/", Replace=curdir.S, RecursiveReplace=False)
rp_3 = Representation(rep_4.Representation)
pa_ur = Text(rep_5)
ur = Url(rep_4.Url)
rp_4 = ClusterOutput(rp_3)
ur_2 = ClusterOutput(ur)
pa_ur_2 = ClusterOutput(pa_ur)
